# Grasshopper definition Sudden CNC Post.gh (Grasshopper 1.0.7)
# plug-ins: Human, Pufferfish, treesloth01, froGH, EleFront, Telepathy, MetaHopper, Imaging Library, ToggleV6, Wombat, ClipperComponents, Heteroptera, magicteddy

panel = Panel("""MDF
Corian
Plywood
Polypropilen
Aluminum""")
panel_2 = Panel("""4
5
6
8
10
12
12.3
16
18
19
22
25
27
32
40
58""")
valuelist_name = Panel("Material")
valuelist_name_2 = Panel("MatThickness")
pvl = PopulateValueList(Name=valuelist_name, Keys=panel, Values=panel)  # inputs Keys: list, Values: list
# ---------- pvl: Python ----------
"""
Populate Value List
    Inputs:
        Name: {item,str}
        Keys: {list,str}
        Values: {list,str}
    Outputs:
    Remarks:
        Author: Anders Holden Deleuran (BIG IDEAS)
        Rhino: 6.30.20266.14531
        Version: 210108
"""

ghenv.Component.Name = "PopulateValueList"
ghenv.Component.NickName = "PVL"

import Grasshopper as gh

if Keys and Values:
    for obj in ghenv.Component.OnPingDocument().Objects:
        if type(obj) is gh.Kernel.Special.GH_ValueList:
            if obj.NickName == Name:
                if obj.ListItems.Count:
                    selected = obj.FirstSelectedItem.Name
                else:
                    selected = None
                obj.ListItems.Clear()
                for k,v in zip(Keys,Values):
                    vli = gh.Kernel.Special.GH_ValueListItem(str(k),str('"' + v + '"'))
                    obj.ListItems.Add(vli)
                if selected in Keys:
                    obj.SelectItem(Keys.index(selected))
                obj.ExpireSolution(True)
# ---------- end pvl ----------
pvl_2 = PopulateValueList(Name=valuelist_name_2, Keys=panel_2, Values=panel_2)  # inputs Keys: list, Values: list; same code as pvl
matthickness = ValueList({"4", "5", "6", "8", "10", "12", "12.3", "16", "18", "19", "22", "25", "27", "32", "40", "58"}, selected="12.3")
matthickness_2 = ValueList({"4", "5", "6", "8", "10", "12", "12.3", "16", "18", "19", "22", "25", "27", "32", "40", "58"}, selected="10")
matthickness_3 = ValueList({"4", "5", "6", "8", "10", "12", "12.3", "16", "18", "19", "22", "25", "27", "32", "40", "58"}, selected="16")
matthickness_4 = ValueList({"4", "5", "6", "8", "10", "12", "12.3", "16", "18", "19", "22", "25", "27", "32", "40", "58"}, selected="19")
matthickness_5 = ValueList({"4", "5", "6", "8", "10", "12", "12.3", "16", "18", "19", "22", "25", "27", "32", "40", "58"}, selected="22")
matthickness_6 = ValueList({"4", "5", "6", "8", "10", "12", "12.3", "16", "18", "19", "22", "25", "27", "32", "40", "58"}, selected="25")
matthickness_7 = ValueList({"4", "5", "6", "8", "10", "12", "12.3", "16", "18", "19", "22", "25", "27", "32", "40", "58"}, selected="40")
matthickness_8 = ValueList({"4", "5", "6", "8", "10", "12", "12.3", "16", "18", "19", "22", "25", "27", "32", "40", "58"}, selected="27")
matthickness_9 = ValueList({"4", "5", "6", "8", "10", "12", "12.3", "16", "18", "19", "22", "25", "27", "32", "40", "58"}, selected="8")
material = ValueList({"MDF", "Corian", "Plywood", "Polypropilen", "Aluminum"}, selected="Corian")
material_2 = ValueList({"MDF", "Corian", "Plywood", "Polypropilen", "Aluminum"}, selected="MDF")
material_3 = ValueList({"MDF", "Corian", "Plywood", "Polypropilen", "Aluminum"}, selected="MDF")
material_4 = ValueList({"MDF", "Corian", "Plywood", "Polypropilen", "Aluminum"}, selected="MDF")
material_5 = ValueList({"MDF", "Corian", "Plywood", "Polypropilen", "Aluminum"}, selected="MDF")
material_6 = ValueList({"MDF", "Corian", "Plywood", "Polypropilen", "Aluminum"}, selected="MDF")
material_7 = ValueList({"MDF", "Corian", "Plywood", "Polypropilen", "Aluminum"}, selected="Plywood")
material_8 = ValueList({"MDF", "Corian", "Plywood", "Polypropilen", "Aluminum"}, selected="Plywood")
material_9 = ValueList({"MDF", "Corian", "Plywood", "Polypropilen", "Aluminum"}, selected="Polypropilen")
material_10 = ValueList({"MDF", "Corian", "Plywood", "Polypropilen", "Aluminum"}, selected="Aluminum")
matthickness_10 = ValueList({"4", "5", "6", "8", "10", "12", "12.3", "16", "18", "19", "22", "25", "27", "32", "40", "58"}, selected="58")
mat_width = Slider(760, range=0..10000)
mat_width_2 = Slider(2010, range=0..10000)
mat_width_3 = Slider(2010, range=0..10000)
mat_width_4 = Slider(2010, range=0..10000)
mat_width_5 = Slider(2010, range=0..10000)
mat_width_6 = Slider(2010, range=0..10000)
mat_width_7 = Slider(1220, range=0..10000)
mat_width_8 = Slider(1220, range=0..10000)
mat_width_9 = Slider(1500, range=0..10000)
mat_height = Slider(3680, range=0..10000)
mat_height_2 = Slider(2780, range=0..10000)
mat_height_3 = Slider(2780, range=0..10000)
mat_height_4 = Slider(2780, range=0..10000)
mat_height_5 = Slider(2780, range=0..10000)
mat_height_6 = Slider(2780, range=0..10000)
mat_height_7 = Slider(2440, range=0..10000)
mat_height_8 = Slider(2440, range=0..10000)
mat_height_9 = Slider(3000, range=0..10000)
mat_height_10 = Slider(3000, range=0..10000)
mat_width_10 = Slider(150, range=0..10000)
format = Format(Format="{0} {1}x{2}x{3}", Culture=127, Data0=material, Data1=matthickness, Data2=mat_height, Data3=mat_width)
format_2 = Format(Format="{0} {1}x{2}x{3}", Culture=127, Data0=material_2, Data1=matthickness_2, Data2=mat_height_2, Data3=mat_width_2)
format_3 = Format(Format="{0} {1}x{2}x{3}", Culture=127, Data0=material_3, Data1=matthickness_3, Data2=mat_height_3, Data3=mat_width_3)
format_4 = Format(Format="{0} {1}x{2}x{3}", Culture=127, Data0=material_4, Data1=matthickness_4, Data2=mat_height_4, Data3=mat_width_4)
format_5 = Format(Format="{0} {1}x{2}x{3}", Culture=127, Data0=material_5, Data1=matthickness_5, Data2=mat_height_5, Data3=mat_width_5)
format_6 = Format(Format="{0} {1}x{2}x{3}", Culture=127, Data0=material_6, Data1=matthickness_6, Data2=mat_height_6, Data3=mat_width_6)
format_7 = Format(Format="{0} {1}x{2}x{3}", Culture=127, Data0=material_7, Data1=matthickness_7, Data2=mat_height_7, Data3=mat_width_7)
format_8 = Format(Format="{0} {1}x{2}x{3}", Culture=127, Data0=material_8, Data1=matthickness_8, Data2=mat_height_8, Data3=mat_width_8)
format_9 = Format(Format="{0} {1}x{2}x{3}", Culture=127, Data0=material_9, Data1=matthickness_9, Data2=mat_height_9, Data3=mat_width_9)
format_10 = Format(Format="{0} {1}x{2}x{3}", Culture=127, Data0=material_10, Data1=matthickness_10, Data2=mat_height_10, Data3=mat_width_10)
merge = Merge(Data1=format, Data2=matthickness, Data3=mat_height, Data4=mat_width)
merge_2 = Merge(Data1=format_2, Data2=matthickness_2, Data3=mat_height_2, Data4=mat_width_2)
merge_3 = Merge(Data1=format_3, Data2=matthickness_3, Data3=mat_height_3, Data4=mat_width_3)
merge_4 = Merge(Data1=format_4, Data2=matthickness_4, Data3=mat_height_4, Data4=mat_width_4)
merge_5 = Merge(Data1=format_5, Data2=matthickness_5, Data3=mat_height_5, Data4=mat_width_5)
merge_6 = Merge(Data1=format_6, Data2=matthickness_6, Data3=mat_height_6, Data4=mat_width_6)
merge_7 = Merge(Data1=format_7, Data2=matthickness_7, Data3=mat_height_7, Data4=mat_width_7)
merge_8 = Merge(Data1=format_8, Data2=matthickness_8, Data3=mat_height_8, Data4=mat_width_8)
merge_9 = Merge(Data1=format_9, Data2=matthickness_9, Data3=mat_height_9, Data4=mat_width_9)
merge_10 = Merge(Data1=format_10, Data2=matthickness_10, Data3=mat_height_10, Data4=mat_width_10)
entwine = Entwine(
    Branch0X=merge,
    Branch1X=merge_2,
    Branch2X=merge_3,
    Branch3X=merge_4,
    Branch4X=merge_5,
    Branch5X=merge_6,
    Branch6X=merge_8,
    Branch7X=merge_9,
    Branch8X=merge_10,
    Branch9X=merge_7,
    FlattenInputs=False)  # -> simplify(Result)
item = ListItem(List=entwine, Index=0, Wrap=True)  # -> flatten(Item)
tstat = TreeStatistics(Tree=entwine)  # -> Paths, Length, Count
tsort = SortText(Keys=item, Values=tstat.Paths, Culture=127)  # -> Keys, Values
branch = TreeBranch(Tree=entwine, Path=tsort.Values, MaintainPaths=False)

list = ItemSelector(
    tsort.Keys,
    {"Aluminum 58x3000x150", "Corian 12.3x3680x760", "MDF 10x2780x2010", "MDF 16x2780x2010", "MDF 19x2780x2010", "MDF 22x2780x2010", "MDF 25x2780x2010", "Plywood 27x2440x1220", "Plywood 40x2440x1220", "Polypropilen 8x3000x1500"}, selected="Corian 12.3x3680x760")
z0 = Slider(0, range=0..51)
clearance_plane = Slider(3, range=1..40)

mindex = MemberIndex(Set=tsort.Keys, Member=list)  # -> Index, Count
path = ConstructPath(Indices=mindex.Index)
branch_2 = TreeBranch(Tree=branch, Path=path, MaintainPaths=True)
item_2 = ListItem(List=branch_2, Index=0, Wrap=True)  # -> Item, Item1, Item2, Item3
split = TextSplit(Text=item_2.Item, Separators=" ")
item_3 = ListItem(List=split, Index=0, Wrap=True)
flatten = FlattenTree(Tree=item_2.Item1, Path="{0}")
concat = Concatenate(FragmentA=item_2.Item1, FragmentB=item_3)

z0_2 = ValueList({"Top Of Material": 0, "Bottom Of Material": 1, "Custom": 2}, selected="Bottom Of Material")
z0_top_bottom = StreamFilter(Gate=z0_2, Stream0=[z0, z0_2], Stream1=[flatten, z0_2], Stream2=[z0, z0_2])

# ---- group: LCS
wcs = Point()

# ---- group: Sheets
sheet = Curve()

# ---- group: 1 category
crv = Curve()

# ---- group: 2 category
crv_2 = Curve()

# ---- group: 3 category
crv_3 = Curve()

# ---- group: Save GH Project
filename_custom = BooleanToggle(False)
read_filename = Button()
python = GhPythonScript(x=read_filename)  # -> rhFile, rhFolder, ghFile
# ---------- python: Python ----------
import Rhino
import os

if Rhino.RhinoDoc.ActiveDoc.Path:
    rhFile = Rhino.RhinoDoc.ActiveDoc.Name[:-4]
    rhFolder = Rhino.RhinoDoc.ActiveDoc.Path.rpartition("\\")[0]    
ghfullpath = ghdoc.Path
if ghfullpath:
    ghFile = os.path.basename(ghfullpath)[:-3]
else:
    ghFile = None
# ---------- end python ----------
panel_3 = Panel(python.rhFile)
save_gh_file = Button()
number_slider = Slider(1, range=0..50)
filter = StreamFilter(Gate=filename_custom, Stream0=python.rhFile, Stream1="Номер заказа")
format_11 = Format(Format="\{2}. {0}-{1}", Culture=127, Data0=concat, Data1=number_slider, Data2=filter)
len = TextLength(Text=number_slider)  # -> expr("x+1", Length)
len_2 = TextLength(Text=format_11)
equals = Equality(FirstNumber=number_slider, SecondNumber=0)  # -> Equality, Inequality
subtraction = Subtraction(A=len_2, B=len)
addition = Addition(A=len, B=Slider(2, range=0..100))
fragment = TextFragment(Text=format_11, Start=0, Count=subtraction)
concat_2 = Concatenate(FragmentA="\", FragmentB=fragment)
filter_2 = StreamFilter(Gate=equals.Equality, Stream0=format_11, Stream1=concat_2)
f_ghsave = SaveGHFile(FilePath=python.rhFolder, FileName=filter_2, SaveTrigger=save_gh_file)  # -> SavedFilePath, SavedFileStatus

# ----
cluster = Cluster_3(category=2, G=crv)
cluster_2 = Cluster_3(category=2, G=crv_2)
cluster_3 = Cluster_3(category=3, G=crv_3)
merge_11 = Merge(Data1=cluster, Data2=cluster_2, Data3=cluster_3)
pipeline = GeometryPipeline(
    GroupByLayer=False,
    GroupByType=False,
    IncludeHidden=True,
    IncludeLocked=True,
    LayerFilter="*",
    NameFilter="*",
    SublayerFiltering=True,
    TypeFilter=4)
panel_4 = Panel(merge_11)
null = NullItem(Item=wcs)  # -> NullFlags, InvalidFlags, Description

docinfo = DocumentInfo(AutoUpdate=False, Recursive=invert(False))  # -> DocumentName, DocumentFilePath, Components, Params, _3rdPartyAssemblies; disabled
cluster_4 = Cluster_2(T=docinfo._3rdPartyAssemblies)  # disabled
panel_5 = Panel(cluster_4)  # disabled

sort_geometry = ValueList({"None": 0, "Bottom to Top": 1, "Top to Bottom": 2, "Left to Right": 3, "Right to Left": 4, "Minimum distance": 5, "By Selection": 6}, selected="Minimum distance")
geometry_control_point = ValueList({"Curve Seam": 4, "Lower Left": 0, "Lower Right": 1, "Upper Right": 2, "Upper Left": 3}, selected="Curve Seam")

nested_geometry = BooleanToggle(False)
bit_position = ValueList({"Outside curve": 0, "Inside curve": 1, "Along curve": 2}, selected="Outside curve")
corners = ValueList({"Sharp": 1, "Round": 2, "Dog-Bone": 3}, selected="Round")

cut_levels_order = ValueList({"Depth": 0, "Level": 1}, selected="Depth")
cut_direction = ValueList({"Climb (Down cut)": 0, "Conventional (Up cut)": 1, "Mixed": 2}, selected="Conventional (Up cut)")
step_z_cut = Slider(10, range=1..100)
cut_feed_mm_min = Slider(3600, range=100..12000)
engage_feed_mm_min = Slider(2000, range=100..12000)
offset = Slider(0, range=-50..50)
plunge_feed_mm_min = Slider(2000, range=100..12000)

entry = ValueList({"None": 0, "Along Path": 1, "Zig-Zag": 2}, selected="Along Path")
path_length = Slider(30, range=0..100)

unweave = Unweave(List=z0_top_bottom, UnweavePattern=[0, 1])  # -> Data0, Data1
addition_2 = Addition(A=clearance_plane, B=unweave.Data0)
z0_3 = Panel(unweave.Data0)

start_selection = BooleanToggle(False)
reset_selection = Button()

start_depth = Slider(0, range=-100..100)
end_depth = Slider(12.3, range=0..100)
finish_depth = Slider(0, range=0..100)

dom = ConstructDomain(DomainStart=0, DomainEnd=item_2.Item1)
remap = RemapNumbers(Value=unweave.Data0, Source=dom, Target=item_2.Item1)  # -> Mapped, Clipped
Z = UnitZ(Factor=remap.Clipped)
panel_6 = Panel(remap.Clipped)

d2 = RemoteReceiver()
d3 = RemoteReceiver()
d4 = RemoteReceiver()
d5 = RemoteReceiver()
d6 = RemoteReceiver()
d7 = RemoteReceiver()
d8 = RemoteReceiver()
d9 = RemoteReceiver()
d10 = RemoteReceiver()
d11 = RemoteReceiver()
d12 = RemoteReceiver()
d13 = RemoteReceiver()

pl = ConstructPlane(Origin=wcs, XAxis=Vector(1, 0, 0), YAxis=Vector(0, 1, 0))
rectangle = Rectangle(Plane=pl, XSize=item_2.Item3, YSize=item_2.Item2, Radius=0)  # -> Rectangle, Length
null_2 = NullItem(Item=sheet)  # -> NullFlags, InvalidFlags, Description
pdecon = Deconstruct(Point=wcs)  # -> XComponent, YComponent, ZComponent

ma = MassAddition(Input=null_2.NullFlags)  # -> Result, PartialResults

filter_3 = StreamFilter(Gate=ma.Result, Stream0=sheet, Stream1=rectangle.Rectangle)
brec = BoundingRectangle(Geometry=filter_3, Plane=PlaneXY(0, 0, 0), Axis=0, Slide=0, Union=True)  # -> Bounding, DimensionX, DimensionY
area = Area(Geometry=brec.Bounding)  # -> Area, Centroid

swatch = ColourSwatch(SwatchColor=RGB(112, 47, 47))
symadv = SymbolAdvanced(
    Style=6,
    SizePrimary=Slider(5, range=0..100),
    SizeSecondary=10,
    Rotation=0,
    Fill=ColourSwatch(SwatchColor=RGB(153, 0, 0)),
    Edge=swatch,
    Width=2,
    Adjust=False)
symbol = SymbolDisplay(Location=wcs, Display=symadv)
previewlw = CustomPreviewLineweights(Geometry=filter_3, Shader=swatch, Thickness=Slider(3, range=0..10), Absolute=False)

cluster_5 = Cluster(crv=pipeline, relay=filter_3, relay_2=item_2.Item1)  # -> T, L, K, V
filter_4 = StreamFilter(Gate=null.NullFlags, Stream0=cluster_5.T)

# ----
# 1
# sheet
layers = ValueList({"OBG_22MM_SN", "sheet"}, selected="sheet")
valuelist_name_3 = Panel("Layers")
pvl_3 = PopulateValueList(Name=valuelist_name_3, Keys=cluster_5.K, Values=cluster_5.K)  # inputs Keys: list, Values: list; same code as pvl
tmatch = MatchText(Text=layers, Pattern="Default", Case=True)
cull = CullPattern(List=layers, CullPattern=invert(tmatch))
ghpython_script = GhPythonScript(ln=layers)  # -> out, bit, start_depth, end_depth, operation, sorting, remachining
# ---------- ghpython_script: Python ----------
__author__ = "jesterKing"

import re
bit = None
depth = None
start_depth = None
end_depth = None
operation = None
sorting = None
operations = {"SN":0,"VN":1,"VD":2,"VB":3,"GR":4, "SV":5, "RE":6}
sortings = {"DU":1,"UD":2,"LR":3,"RL":4}


if ln:
    p = re.compile("(?P<bit>\w*?)(?:_|__)(?P<depth>[^_]\w*?MM)_(?P<operation>\w*)")
    m = p.match(ln)
    if m:
        bit = m.group("bit")
        depth = m.group("depth")
        depth = depth.replace('_', '.').lstrip('N').rstrip('MM').split('K')[::-1]
        if len(depth) > 1:
            start_depth = depth[1]
        end_depth = depth[0]
        operation = m.group("operation")
        operation = operation.split('_')
        
        if len(operation) > 1:
            sorting = sortings.get(operation[1])
            for op in operation:
                if "RE" in op:
                    remachining = op.lstrip("RE")
        if "RE" in operation[0]:
            operation[0] == "RE"
            remachining = operation[0].lstrip("RE")
            operation = operations.get(operation[0][:2])
        else: 
            operation = operations.get(operation[0])
# ---------- end ghpython_script ----------
expression = Expression(x=ghpython_script.sorting, Expression="if(x=3,1,if(x=4,0,if(x=2,1,if(x=1,3,4))))")
python_2 = GhPythonScript(bit=ghpython_script.bit)  # -> out, bit_dia, bit_h, bit_angle
# ---------- python_2: Python ----------
__author__ = "Saha"
__version__ = "2023.03.02"

import rhinoscriptsyntax as rs
import re

if bit:
    regex = re.compile("([A-Z]*[0-9]*)")
    groups = re.split(regex, bit)
    bit_params = {g[0]: g[1:] for g in groups if g}
    bit_types = ["D", "U", "V", "F", "IN", "T"]
    for bit_type in bit_types:
        if bit_type in bit_params:
            bit_dia = bit_params[bit_type]
            break
    
    #bit_dia = bit_params.get("D", bit_params.get("U", bit_params.get("V", bit_params.get("F", bit_params.get("IN")))))
    bit_angle = bit_params.get("V")
    bit_h = bit_params.get("H")
# ---------- end python_2 ----------
filterlay = FilterByLayer(Geometry=filter_4, Layer=cull, DisableAutoUpdate=False, OnlyReferenced=False, OnlyVisible=True)
bit_dia = Slider(10, range=0..80)
crv_4 = Curve(filterlay)
expression_2 = Expression(x=ghpython_script.sorting, Expression="if(x=3,0,1)")
null_3 = NullItem(Item=ghpython_script.bit)  # -> NullFlags, InvalidFlags, Description
null_4 = NullItem(Item=python_2.bit_dia)  # -> NullFlags, InvalidFlags, Description
null_5 = NullItem(Item=ghpython_script.start_depth)  # -> NullFlags, InvalidFlags, Description
null_6 = NullItem(Item=ghpython_script.end_depth)  # -> NullFlags, InvalidFlags, Description
null_7 = NullItem(Item=ghpython_script.end_depth)  # -> NullFlags, InvalidFlags, Description
null_8 = NullItem(Item=ghpython_script.sorting)  # -> NullFlags, InvalidFlags, Description
rhatt = GetRhinoAttributes(Geometry=crv_4)  # -> Name, Layer, Color
cset = CreateSet(List=rhatt.Color)  # -> Set, Map
filter_5 = StreamFilter(Gate=null_4.NullFlags, Stream0=python_2.bit_dia, Stream1=bit_dia)
filter_6 = StreamFilter(Gate=null_3.NullFlags, Stream0=ghpython_script.bit, Stream1=filter_5)
filter_7 = StreamFilter(Gate=null_5.NullFlags, Stream0=ghpython_script.start_depth, Stream1=start_depth)
filter_8 = StreamFilter(Gate=null_6.NullFlags, Stream0=ghpython_script.end_depth, Stream1=end_depth)
filter_9 = StreamFilter(Gate=null_7.NullFlags, Stream0=ghpython_script.operation, Stream1=bit_position)
filter_10 = StreamFilter(Gate=null_8.NullFlags, Stream0=ghpython_script.sorting, Stream1=sort_geometry)
filter_11 = StreamFilter(Gate=null_8.NullFlags, Stream0=expression, Stream1=geometry_control_point)
filter_12 = StreamFilter(Gate=null_8.NullFlags, Stream0=expression_2, Stream1=cut_direction)
larger = LargerThan(FirstNumber=filter_8, SecondNumber=item_2.Item1)  # -> LargerThan, OrEqualTo
item_4 = ListItem(List=cset.Set, Index=0, Wrap=True)
filter_13 = StreamFilter(Gate=larger.OrEqualTo, Stream0=filter_8, Stream1=item_2.Item1)
tmatch_2 = MatchText(Text=filter_6, RegEx="OBG", Case=True)
concat_3 = Concatenate(FragmentA="D", FragmentB=filter_5)
division = Division(A=filter_5, B=2)
filter_14 = StreamFilter(Gate=tmatch_2, Stream0=filter_6, Stream1=concat_3)
ma_2 = MassAddition(Input=[offset, division])  # -> Result, PartialResults
ma_3 = MassAddition(Input=offset)  # -> Result, PartialResults
subtraction_2 = Subtraction(A=filter_13, B=filter_7)
rep = ReplaceText(Text=cull, Find="OBG", Replace=filter_14, RecursiveReplace=False)
neg = Negative(Value=ma_2.Result)
subtraction_3 = Subtraction(A=subtraction_2, B=finish_depth)
filter_15 = StreamFilter(Gate=filter_9, Stream0=neg, Stream1=neg, Stream2=offset, Stream3=neg, Stream5=0)
division_2 = Division(A=subtraction_3, B=step_z_cut)
round = Round(Number=division_2)  # -> Nearest, Floor, Ceiling
division_3 = Division(A=subtraction_3, B=round.Ceiling)
stack = StackData(Data=division_3, Stack=round.Ceiling)
larger_2 = LargerThan(FirstNumber=finish_depth, SecondNumber=0)  # -> LargerThan, OrEqualTo
ma_4 = MassAddition(Input=stack)  # -> Result, PartialResults
addition_3 = Addition(A=filter_7, B=ma_4.PartialResults)
lng = ListLength(List=addition_3)
ins = InsertItems(List=stack, Item=finish_depth, Indices=lng, Wrap=True)
lng_2 = ListLength(List=addition_3)
ins_2 = InsertItems(List=addition_3, Item=filter_8, Indices=lng_2, Wrap=True)
filter_16 = StreamFilter(Gate=larger_2.LargerThan, Stream0=addition_3, Stream1=ins_2)
filter_17 = StreamFilter(Gate=larger_2.LargerThan, Stream0=stack, Stream1=ins)
panel_7 = Panel(filter_17)
panel_8 = Panel(filter_16)
offset_2 = Slider(80, range=0..100)
offset_3 = Evaluate(F="(x/100)*y", x=filter_5, y=offset_2)
division_4 = Division(A=filter_5, B=2)
Z_2 = UnitZ(Factor=1)
neg_2 = Negative(Value=Z_2)
number_slider_2 = Slider(400, range=0..1000)
setscribble = SetScribbleProperties(Scribble="Grasshopper.Kernel.Types.GH_ObjectWrapper", ScribbleText=rep, ScribbleSize=number_slider_2)
knob = ControlKnob(Decimals=0, Limit=True, Maximum=11, Minimum=1, Range=10, Value=1)
concat_4 = Concatenate(FragmentA=knob, FragmentC="-", FragmentB=Slider(1, range=1..10))
start_code = STARTCODE()
end_code = ENDCODE()
setscribble_2 = SetScribbleProperties(Scribble="Grasshopper.Kernel.Types.GH_ObjectWrapper", ScribbleText=knob, ScribbleSize=number_slider_2)
addition_4 = Addition(A=unweave.Data1, B=1)
txt = Text(filter_14)
format_12 = Format(Format="{0}.{1}-{2}", Culture=127, Data0=knob, Data1=txt, Data2=addition_4)
panel_9 = Panel(format_12)
save = Toggle(SpecialInteger=True)
open_folder = Button()
toolpath_streaming_folder = FilePath("E:\Работа\Simple CNC Post TEST\")
concat_5 = Concatenate(FragmentA="D", FragmentB=knob)

crv_5 = Curve(crv_4)
cluster_6 = Cluster_19(crv=crv_5, relay=nested_geometry)  # -> outside, inside, open
cir = Circle(Plane=PlaneXY(0, 0, 0), Radius=1)
cir_2 = Circle(Plane=PlaneXY(0, 0, 0), Radius=1)
cir_3 = Circle(Plane=PlaneXY(0, 0, 0), Radius=1)
flip = FlipCurve(Curve=cir)  # -> Curve, Flag
flip_2 = FlipCurve(Curve=cir_2)  # -> Curve, Flag
flip_3 = FlipCurve(Curve=cir_3)  # -> Curve, Flag
filter_18 = StreamFilter(Gate=filter_9, Stream0=flip.Curve, Stream1=cir, Stream3=cir, Stream5=cir, Stream6=cir)
filter_19 = StreamFilter(Gate=filter_9, Stream0=cir_2, Stream1=flip_2.Curve, Stream3=flip_2.Curve, Stream5=flip_2.Curve, Stream6=flip_2.Curve)
filter_20 = StreamFilter(Gate=filter_9, Stream0=flip_3.Curve, Stream1=cir_3, Stream2=flip_3.Curve, Stream3=cir_3, Stream5=cir_3, Stream6=cir_3)
flip_4 = FlipCurve(Curve=cluster_6.outside, Guide=graft(filter_18))  # -> Curve, Flag
flip_5 = FlipCurve(Curve=cluster_6.inside, Guide=graft(filter_19))  # -> Curve, Flag
flip_6 = FlipCurve(Curve=cluster_6.open, Guide=graft(filter_20))  # -> Curve, Flag
change_curve_seam = ChangeCurveSeam(G=filter_11, crv=flip_4.Curve, crv_2=crv_4)  # -> simplify(T)
change_curve_seam_2 = ChangeCurveSeam(G=filter_11, crv=flip_5.Curve, crv_2=crv_4)  # -> simplify(T)
offset_4 = Offset(Curve=change_curve_seam, Distance=filter_15, Plane=PlaneXY(0, 0, 0), Corners=corners)
offset_5 = Offset(Curve=change_curve_seam_2, Distance=filter_15, Plane=PlaneXY(0, 0, 0), Corners=corners)
gate = StreamGate(Stream=offset_4, Gate=filter_9)  # -> Target0, Target1, Target2, Target3, Target4, Target5, Target6
gate_2 = StreamGate(Stream=offset_5, Gate=filter_9)  # -> Target0, Target1, Target2, Target3, Target4, Target5, Target6

offset_6 = Offset(Curve=flip_6.Curve, Distance=filter_15, Plane=PlaneXY(0, 0, 0), Corners=corners)
merge_12 = Merge(Data1=change_curve_seam, Data2=change_curve_seam_2)
smart_merge = SmartMerge(D1=change_curve_seam, D2=change_curve_seam_2, ec=False, fa=False, ha=False, link=False)
gate_3 = StreamGate(Stream=offset_6, Gate=filter_9)  # -> Target0, Target1, Target2, Target3, Target4, Target5, Target6
center = Center(Geometric=gate.Target5)  # -> Center, Dimension
area_2 = Area(Geometry=[gate_2.Target5, gate.Target5])  # -> Area, Centroid
entwine_2 = Entwine(Branch0X=gate.Target2, Branch1X=gate_2.Target2, Branch2X=gate_3.Target2, FlattenInputs=False)
entwine_3 = Entwine(Branch0X=gate.Target0, Branch1X=gate_2.Target1, Branch2X=gate_3.Target0, FlattenInputs=False)
entwine_4 = Entwine(Branch0X=gate.Target1, Branch1X=gate_2.Target0, Branch2X=gate_3.Target1, FlattenInputs=False)
renumber = RenumberPaths(Data=entwine_2)
renumber_2 = RenumberPaths(Data=entwine_3)
renumber_3 = RenumberPaths(Data=entwine_4)
cir_4 = Circle(Plane=center.Center, Radius=division_4)
line = LineSDL(Start=center.Center, Direction=neg_2, Length=filter_8)
boundary = BoundarySurfaces(Edges=cir_4)
flip_7 = FlipCurve(Curve=line)  # -> Curve, Flag
preview = CustomPreview(Geometry=boundary, Material=ColourSwatch(SwatchColor=RGBA(69, 112, 26, 100)))

flip_8 = FlipCurve(Curve=renumber_2)  # -> Curve, Flag
flip_9 = FlipCurve(Curve=renumber_3)  # -> Curve, Flag
flip_10 = FlipCurve(Curve=renumber)  # -> Curve, Flag
filter_21 = StreamFilter(Gate=filter_12, Stream0=renumber, Stream1=flip_10.Curve, Stream2=renumber)
filter_22 = StreamFilter(Gate=filter_12, Stream0=renumber_2, Stream1=flip_8.Curve, Stream2=renumber_2)
filter_23 = StreamFilter(Gate=filter_12, Stream0=renumber_3, Stream1=flip_9.Curve, Stream2=renumber_3)

prune = PruneTree(Tree=filter_21, Minimum=1, Maximum=0)
prune_2 = PruneTree(Tree=filter_22, Minimum=1, Maximum=0)
prune_3 = PruneTree(Tree=filter_23, Minimum=1, Maximum=0)
polyoffset = PolylineOffset(
    Polylines=prune,
    Distance=division_4,
    Plane=Plane(origin=(0, 0, 0), x=(0, 0, 0), y=(0, 0, 0)),
    Tolerance=0.001,
    ClosedFillet=0,
    OpenFillet=0,
    Miter=2)  # -> Contour, Holes
polyoffset_2 = PolylineOffset(
    Polylines=prune_2,
    Distance=division_4,
    Plane=Plane(origin=(0, 0, 0), x=(0, 0, 0), y=(0, 0, 0)),
    Tolerance=0.001,
    ClosedFillet=0,
    OpenFillet=1,
    Miter=2)  # -> Contour, Holes
polyoffset_3 = PolylineOffset(
    Polylines=prune_3,
    Distance=division_4,
    Plane=Plane(origin=(0, 0, 0), x=(0, 0, 0), y=(0, 0, 0)),
    Tolerance=0.001,
    ClosedFillet=0,
    OpenFillet=1,
    Miter=2)  # -> Contour, Holes
crv_6 = Curve(polyoffset_3.Holes)

move = Move(Geometry=prune, Motion=Z)  # -> Geometry, Transform
move_2 = Move(Geometry=prune_2, Motion=Z)  # -> Geometry, Transform
move_3 = Move(Geometry=prune_3, Motion=Z)  # -> Geometry, Transform
renumber_4 = RenumberPaths(Data=prune)
renumber_5 = RenumberPaths(Data=prune_2)
renumber_6 = RenumberPaths(Data=prune_3)

number_slider_3 = Slider(12, range=0..20)
swatch_2 = ColourSwatch(SwatchColor=RGB(95, 112, 26))
swatch_3 = ColourSwatch(SwatchColor=RGB(112, 18, 122))
swatch_4 = ColourSwatch(SwatchColor=RGB(26, 76, 112))
preview_2 = CustomPreview(Geometry=move.Geometry, Material=swatch_2)
preview_3 = CustomPreview(Geometry=move_2.Geometry, Material=swatch_3)
preview_4 = CustomPreview(Geometry=move_3.Geometry, Material=swatch_4)
crvdir = CurveDirectionDisplay(Curves=move.Geometry, Color=swatch_2, Size=number_slider_3)
crvdir_2 = CurveDirectionDisplay(Curves=move_2.Geometry, Color=swatch_3, Size=number_slider_3)
crvdir_3 = CurveDirectionDisplay(Curves=move_3.Geometry, Color=swatch_4, Size=number_slider_3)
toggle = GroupToggle(ToggleActive=False, ToggleVisible=True)  # disabled

clean_islands = BooleanToggle(True)
list_2 = ValueList({"Round": 0, "Square": 1, "Miter": 2}, selected="Round")
list_3 = ValueList({"Round": 0, "Square": 1, "Miter": 2}, selected="Round")
pocketing = Pocketing(
    A=filter_9,
    _1=smart_merge,
    cf=list_2,
    of=list_3,
    cut_direction=filter_12,
    T=Z,
    A_2=offset_3,
    clean_islands=clean_islands,
    bit_dia=division_4,
    D=division_4)  # -> S, A_3, G, crv_3, S_2
swatch_5 = ColourSwatch(SwatchColor=RGB(156, 31, 62))
crvdir_4 = CurveDirectionDisplay(Curves=pocketing.G, Color=swatch_5, Size=number_slider_3)  # disabled
preview_5 = CustomPreview(Geometry=pocketing.S, Material=ColourSwatch(SwatchColor=RGBA(156, 31, 62, 100)))
preview_6 = CustomPreview(Geometry=pocketing.G, Material=swatch_5)
preview_7 = CustomPreview(Geometry=pocketing.crv_3, Material=ColourSwatch(SwatchColor=RGB(255, 157, 0)))
preview_8 = CustomPreview(Geometry=pocketing.S_2, Material=ColourSwatch(SwatchColor=RGBA(255, 157, 0, 100)))
toggle_2 = GroupToggle(ToggleActive=True, ToggleVisible=False)  # disabled

re_machining = ReMachining(A=filter_9, _1=smart_merge, relay=ghpython_script.remachining, A_2=filter_5, A_3=offset_3, T=Z)  # -> T_2, S, G
swatch_6 = ColourSwatch(SwatchColor=RGB(42, 86, 219))
crvdir_5 = CurveDirectionDisplay(Curves=re_machining.G, Color=RGB(255, 0, 0), Size=number_slider_3)  # disabled
preview_9 = CustomPreview(Geometry=re_machining.S, Material=swatch_6)
preview_10 = CustomPreview(Geometry=re_machining.G, Material=swatch_6)
toggle_3 = GroupToggle(ToggleActive=True, ToggleVisible=False)  # disabled

polyboolean = PolylineBoolean(
    A=polyoffset.Contour,
    B=polyoffset.Holes,
    BooleanType=2,
    Plane=Plane(origin=(0, 0, 0), x=(0, 0, 0), y=(0, 0, 0)),
    Tolerance=0.001,
    EvenOdd=True)
polyboolean_2 = PolylineBoolean(
    A=polyoffset_2.Contour,
    B=polyoffset_2.Holes,
    BooleanType=2,
    Plane=Plane(origin=(0, 0, 0), x=(0, 0, 0), y=(0, 0, 0)),
    Tolerance=0.001,
    EvenOdd=True)
polyboolean_3 = PolylineBoolean(
    A=polyoffset_3.Contour,
    B=polyoffset_3.Holes,
    BooleanType=2,
    Plane=Plane(origin=(0, 0, 0), x=(0, 0, 0), y=(0, 0, 0)),
    Tolerance=0.001,
    EvenOdd=True)
boundary_2 = BoundarySurfaces(Edges=polyboolean_2)
boundary_3 = BoundarySurfaces(Edges=polyboolean_3)
boundary_4 = BoundarySurfaces(Edges=polyboolean)
preview_11 = CustomPreview(Geometry=boundary_2, Material=ColourSwatch(SwatchColor=RGBA(112, 18, 122, 100)))
preview_12 = CustomPreview(Geometry=boundary_3, Material=ColourSwatch(SwatchColor=RGBA(26, 76, 112, 100)))
preview_13 = CustomPreview(Geometry=boundary_4, Material=ColourSwatch(SwatchColor=RGBA(95, 112, 26, 100)))
toggle_4 = GroupToggle(ToggleActive=True, ToggleVisible=False)  # disabled

crv_7 = Curve([renumber_4, renumber_5, renumber_6])
cluster_7 = Cluster_8(C=move_2.Geometry, cf=swatch_3, ce=swatch_3)  # -> P, D; disabled
simplify = SimplifyCurve(Curve=reparameterize(crv_7))  # -> Curve, Simplified
symbol_2 = SymbolDisplay(Location=cluster_7.P, Display=cluster_7.D)  # disabled
sorted_inside_and_outside_curves = Curve(simplify.Curve)
previewlw_2 = CustomPreviewLineweights(Geometry=prune, Shader=swatch_2, Thickness=[filter_5, filter_5], Absolute=invert(False))  # disabled
previewlw_3 = CustomPreviewLineweights(Geometry=prune_2, Shader=swatch_3, Thickness=filter_5, Absolute=invert(False))  # disabled
previewlw_4 = CustomPreviewLineweights(Geometry=prune_3, Shader=swatch_4, Thickness=[filter_5, filter_5], Absolute=invert(False))  # disabled
filter_24 = StreamFilter(
    Gate=filter_9,
    Stream0=sorted_inside_and_outside_curves,
    Stream1=sorted_inside_and_outside_curves,
    Stream2=sorted_inside_and_outside_curves,
    Stream3=pocketing.A_3,
    Stream5=line,
    Stream6=re_machining.T_2)  # -> simplify(Stream)

# ---- group: Shortest Walk
shortest_walk = ShortestWalk(G=filter_24)

# ----
flatten_2 = FlattenTree(Tree=filter_24, Path="{0}")
clickm = ClickableMesh(Enable=start_selection, Meshes=flatten_2)  # -> SelectedMeshes, SelectedIndices, MouseLine
cluster_8 = Cluster_5(
    enable=start_selection,
    reset=reset_selection,
    d1=clickm.SelectedIndices,
    G=clickm.SelectedMeshes,
    L=flatten_2,
    i=clickm.SelectedIndices,
    L_2=flatten_2,
    P=area.Centroid,
    L_3=flatten_2,
    A=filter_10)  # -> T, T_2, L_4, R, S
filter_25 = StreamFilter(Gate=start_selection, Stream1=cluster_8.T)
filter_26 = StreamFilter(Gate=cluster_8.R, Stream1=cluster_8.T_2)

sort_groups = SortGroups(T=shortest_walk)  # -> W, S; disabled
sort_groups_2 = SortGroups_2(T=shortest_walk)  # -> D, D_2
lng_3 = ListLength(List=flatten(filter_24))
smaller = SmallerThan(FirstNumber=lng_3, SecondNumber=1)  # -> SmallerThan, OrEqualTo
filter_27 = StreamFilter(Gate=smaller.OrEqualTo, Stream0=filter_10, Stream1=0)
pdecon_2 = Deconstruct(Point=sort_groups_2.D_2)  # -> XComponent, YComponent, ZComponent
pdecon_3 = Deconstruct(Point=sort_groups_2.D_2)  # -> XComponent, YComponent, ZComponent
center_between_pts = CenterBetweenPts(L=sort_groups_2.D_2)
cp = ClosestPoint(Point=wcs, Cloud=sort_groups_2.D_2)  # -> ClosestPoint, CPIndex, Distance
autosorting = GhPythonScript(start_point=wcs, other_points=sort_groups_2.D_2)  # -> out, sorted_points; inputs other_points: list of Point3d
# ---------- autosorting: Python ----------
__author__ = "Siemen"

import rhinoscriptsyntax as rs


def shortestpath(spt, pts):
    
    Origin = (0,0,0)
    start_point = spt
    orderedlist = []
    cullist = pts
    
    
    
    distlist =[]
    
    for x in pts:
        distlist = []
        for x in cullist:
            
            dist = rs.Distance(start_point, x)
            dist = float(dist)
            
            distlist.append(dist)
            
        
        comblist = zip(distlist,cullist)
        
        comblist.sort()
        
        comblist = zip(*comblist)
        
        
        cullist = list(comblist[1])
        
        
        
        start_point = cullist[0]
        
        orderedlist.append(start_point)
        cullist.remove(start_point)
        
        
    return orderedlist
    
    
    
    
if other_points:
    if not start_point: start_point = (0,0,0)
    sorted_points = shortestpath(start_point, other_points)
else:
    print "No input curves"
# ---------- end autosorting ----------
sort = SortList(Keys=pdecon_2.YComponent, ValuesA=pdecon_2.XComponent)  # -> Keys, ValuesA
sort_2 = SortList(Keys=pdecon_3.XComponent, ValuesA=pdecon_3.YComponent)  # -> Keys, ValuesA
python_3 = PythonScript(Points=sort_groups_2.D_2, Center=center_between_pts)  # -> SortedPoints, Plane; inputs Points: list
# ---------- python_3: Python ----------
import Rhino as rc

def sortPointsAroundCenter(pts,center):
    
    """ Sort a list of points radially around a center """
    
    # Make plane through points and set its origin
    test,plane = rc.Geometry.Plane.FitPlaneToPoints(pts)
    plane.Origin = center
    
    # Calculate vectors from center to points
    vecs = [pt - center for pt in pts]
    
    # Calculate angles between vectors and plane X-axis
    angles = [rc.Geometry.Vector3d.VectorAngle(plane.XAxis,v,plane) for v in vecs]
    
    # Sort points by angles
    sortedBoth = sorted(zip(angles,pts))
    sortedPts = [l[1] for l in sortedBoth]
    
    return sortedPts,plane
    

if Points and Center:
    
    SortedPoints,Plane = sortPointsAroundCenter(Points,Center)
# ---------- end python_3 ----------
seqsort = SequentiallySort(Points=sort_groups_2.D_2, Start=cp.CPIndex)  # -> out, Sorted; inputs Points: list of Point3d, Start: Int32
# ---------- seqsort: Python ----------
"""Sequentially sort points by distance.
    Inputs:
        Points: The list of sample points to sort
        Start: The start point for sorting
    Output:
        Sorted: The sorted list of points"""

__author__ = "diff-arch"
__version__ = "0.1.1 (2020-09-25)"


ghenv.Component.Name = "Sequentially Sort"
ghenv.Component.NickName = "SeqSort"


import Rhino.Geometry as rg


def sort_sequentially_rec(pt_cloud, start=0, _sorted_pts=[]):
    """Recursively sorts points by distance.

    Args:
      pt_cloud (Rhino.Geometry.PointCloud): A point cloud to sort
      start (int): A start point index to sort from

    Returns:
      The sequentially sorted points.
    """
    if pt_cloud.Count < 1:
        return _sorted_pts

    test_pt = pt_cloud.PointAt(start)
    _sorted_pts.append(test_pt)
    pt_cloud.RemoveAt(start)

    closest = pt_cloud.ClosestPoint(test_pt)
    if closest == -1:
        return _sorted_pts

    return sort_sequentially_rec(pt_cloud, closest, _sorted_pts)


if __name__ == "__main__":
    # Create a point cloud from the list of points
    pt_cloud = rg.PointCloud(Points)
    # Outputs
    Sorted = sort_sequentially_rec(pt_cloud, Start)
# ---------- end seqsort ----------
pt = ConstructPoint(XCoordinate=sort.ValuesA, YCoordinate=sort.Keys, ZCoordinate=0)
pt_2 = ConstructPoint(XCoordinate=sort_2.Keys, YCoordinate=sort_2.ValuesA, ZCoordinate=0)
pt_3 = Point(reverse(pt_2))
pt_4 = Point(reverse(pt))
filter_28 = StreamFilter(
    Gate=filter_27,
    Stream0=sort_groups_2.D_2,
    Stream1=pt,
    Stream2=pt_4,
    Stream3=pt_2,
    Stream4=pt_3,
    Stream5=flatten(seqsort.Sorted),
    Stream6=cluster_8.S)
lng_4 = ListLength(List=filter_28)
cp_2 = ClosestPoint(Point=filter_28, Cloud=flatten(sort_groups_2.D_2))  # -> ClosestPoint, CPIndex, Distance
series = Series(Start=0, Step=1, Count=lng_4)
int = Integer(cp_2.CPIndex)
int_2 = Integer(series)
cset_2 = CreateSet(List=cp_2.CPIndex)  # -> Set, Map
difference = SetDifference(SetA=int_2, SetB=int)
lng_5 = ListLength(List=difference)
larger_3 = LargerThan(FirstNumber=lng_5, SecondNumber=0)  # -> LargerThan, OrEqualTo
ins_3 = InsertItems(List=cset_2.Set, Item=difference, Indices=-1, Wrap=True)
filter_29 = StreamFilter(Gate=larger_3.LargerThan, Stream0=cp_2.CPIndex, Stream1=ins_3)
Z_3 = UnitZ(Factor=unweave.Data0)
Z_4 = UnitZ(Factor=clearance_plane)
path_2 = ConstructPath(Indices=graft(filter_29))  # -> flatten(Branch)
branch_3 = TreeBranch(Tree=simplify(sort_groups_2.D), Path=path_2, MaintainPaths=False)
graft = GraftTree(Tree=branch_3, IncludeEmptyLists=True, IncludeNullItems=True)
renumber_7 = RenumberPaths(Data=graft)
move_4 = Move(Geometry=renumber_7, Motion=Z_3)  # -> Geometry, Transform
Z_5 = UnitZ(Factor=expr("-x", filter_16))
move_5 = Move(Geometry=move_4.Geometry, Motion=Z_5)  # -> Geometry, Transform
lng_6 = ListLength(List=Z_5)
divide = DivideCurve(Curve=move_4.Geometry, Count=lng_6, Kinks=False)  # -> Points, Tangents, Parameters
shatter = Shatter(Curve=move_4.Geometry, Parameters=divide.Parameters)
equality = Equality(FirstNumber=filter_12, SecondNumber=2)  # -> Equality, Inequality

# ---- group: V-Carve
equals_2 = Equality(FirstNumber=filter_9, SecondNumber=4)  # -> Equality, Inequality
filter_30 = StreamFilter(Gate=equals_2.Equality, Stream1=smart_merge)
prune_4 = PruneTree(Tree=filter_30, Minimum=1, Maximum=0)
move_6 = Move(Geometry=prune_4, Motion=Z_3)  # -> Geometry, Transform
cluster_9 = Cluster_4(G=move_6.Geometry, x=filter_7, A=python_2.bit_angle, A_2=subtraction_3, L=round.Ceiling)  # -> R, L_2
preview_14 = CustomPreview(Geometry=cluster_9.L_2, Material=ColourSwatch(SwatchColor=RGBA(26, 112, 86, 60)))

# ----
filter_31 = StreamFilter(
    Gate=filter_9,
    Stream0=move_5.Geometry,
    Stream1=move_5.Geometry,
    Stream2=move_5.Geometry,
    Stream3=move_5.Geometry,
    Stream4=cluster_9.R,
    Stream5=shatter,
    Stream6=move_5.Geometry)
cls = Closed(Curve=filter_31)  # -> Closed, Periodic
unweave_2 = Unweave(List=filter_31, UnweavePattern=cls.Closed)  # -> Data0, Data1
unweave_3 = Unweave(List=unweave_2.Data1, UnweavePattern=[0, 1])  # -> Data0, Data1
unweave_4 = Unweave(List=unweave_2.Data0, UnweavePattern=[0, 1])  # -> Data0, Data1
flip_11 = FlipCurve(Curve=unweave_3.Data1)  # -> Curve, Flag
flip_12 = FlipCurve(Curve=unweave_4.Data1)  # -> Curve, Flag
weave = Weave(Pattern=[0, 1], Stream0=unweave_3.Data0, Stream1=flip_11.Curve, NullGaps=False)
weave_2 = Weave(Pattern=[0, 1], Stream0=unweave_4.Data0, Stream1=flip_12.Curve, NullGaps=False)
filter_32 = StreamFilter(Gate=equality.Equality, Stream0=unweave_2.Data1, Stream1=weave)
filter_33 = StreamFilter(Gate=equality.Equality, Stream0=unweave_2.Data0, Stream1=weave_2)
weave_3 = Weave(Pattern=cls.Closed, Stream0=filter_33, Stream1=filter_32, NullGaps=False)
cluster_10 = Cluster_9(C=weave_3)
gate_4 = StreamGate(Stream=cluster_10, Gate=cut_levels_order)  # -> Target0, Target1
flip_last = FlipLast(Data=gate_4.Target1)
filter_34 = StreamFilter(Gate=cut_levels_order, Stream0=gate_4.Target0, Stream1=flip_last)
end = EndPoints(Curve=filter_34)  # -> Start, End
tstat_2 = TreeStatistics(Tree=filter_34)  # -> Paths, Length, Count
pdecon_4 = Deconstruct(Point=end.End)  # -> XComponent, YComponent, ZComponent
cset_3 = CreateSet(List=tstat_2.Length)  # -> Set, Map
pt_5 = ConstructPoint(XCoordinate=pdecon_4.XComponent, YCoordinate=pdecon_4.YComponent, ZCoordinate=addition_2)

cls_2 = Closed(Curve=filter_34)  # -> Closed, Periodic
unweave_5 = Unweave(List=filter_34, UnweavePattern=cls_2.Closed)  # -> Data0, Data1
flip_13 = FlipCurve(Curve=unweave_5.Data1)  # -> simplify(Curve), Flag
lng_7 = ListLength(List=filter_17)
weave_4 = Weave(Pattern=cls_2.Closed, Stream0=unweave_5.Data0, Stream1=flip_13.Curve, NullGaps=False)
repeat = RepeatData(Data=0, Length=lng_7)
equals_3 = Equality(FirstNumber=filter_9, SecondNumber=5)  # -> Equality, Inequality
merge_13 = Merge(Data1=0, Data2=path_length)
graft_2 = GraftTree(Tree=weave_4, IncludeEmptyLists=True, IncludeNullItems=True)
filter_35 = StreamFilter(Gate=equals_3.Equality, Stream0=filter_17, Stream1=repeat)
eval = EvaluateLength(Curve=graft_2, Length=merge_13, Normalized=invert(True))  # -> Point, Tangent, Parameter
end_2 = EndPoints(Curve=weave_4)  # -> Start, End
Z_6 = UnitZ(Factor=filter_35)
shatter_2 = Shatter(Curve=graft_2, Parameters=eval.Parameter)
move_7 = Move(Geometry=end_2.Start, Motion=Z_6)  # -> Geometry, Transform
item_5 = ListItem(List=shatter_2, Index=0, Wrap=True)
ln = Line(StartPoint=move_7.Geometry, EndPoint=end_2.Start)
partition = PartitionList(List=flatten(item_5), Size=cset_3.Set)
equals_4 = Equality(FirstNumber=path_length, SecondNumber=0)  # -> Equality, Inequality
smaller_2 = SmallerThan(FirstNumber=entry, SecondNumber=1)  # -> SmallerThan, OrEqualTo
cluster_11 = Cluster_6(G=partition, B=division_3, B_2=path_length)  # -> simplify(C)
or = GateOr(A=equals_4.Equality, B=smaller_2.SmallerThan)
cluster_12 = Cluster_7(T=cluster_11)
filter_36 = StreamFilter(Gate=or, Stream0=cluster_12, Stream1=ln)

preview_15 = CustomPreview(Geometry=filter_36, Material=ColourSwatch(SwatchColor=RGB(217, 13, 108)))
preview_16 = CustomPreview(Geometry=filter_34, Material=ColourSwatch(SwatchColor=RGB(34, 227, 227)))
toggle_5 = GroupToggle(ToggleActive=True, ToggleVisible=False)  # disabled

item_6 = ListItem(List=filter_31, Index=0, Wrap=True)
cluster_13 = Cluster_14(
    x0=pdecon.XComponent,
    y0=pdecon.YComponent,
    Z=addition_2,
    cut_feedrate=cut_feed_mm_min,
    engage_feedrate=engage_feed_mm_min,
    C=filter_36,
    C_2=filter_34,
    A=end.End,
    B=pt_5,
    d2=rep,
    layercolor=item_4)  # -> geometry, R, R_2, L_2, L, L_3, D
lng_8 = ListLength(List=cluster_13.R)
entwine_5 = Entwine(Branch00=cluster_13.R, Branch01=cluster_13.R_2, FlattenInputs=True)  # -> simplify(Result)
larger_4 = LargerThan(FirstNumber=lng_8, SecondNumber=1)  # -> LargerThan, OrEqualTo
filter_37 = StreamFilter(Gate=larger_4.LargerThan, Stream1=entwine_5)
remote_sender = RemoteSender(filter_37)
connected = GetConnectedObjects(Objects=remote_sender)
rename = RenameObject(Objects=connected, Names=concat_4)

end_3 = EndPoints(Curve=item_6)  # -> flatten(Start), flatten(End)
lng_9 = ListLength(List=end_3.Start)
series_2 = Series(Start=1, Step=1, Count=lng_9)
textdot = DefineTextDot(Text=series_2, Location=end_3.Start, Font="Arial", Size=Slider(9, range=0..100))
toggle_6 = GroupToggle(ToggleActive=True, ToggleVisible=False)  # disabled

# ---- group: Simulate
num = Number(Slider(0, range=0..1))
crv_8 = Curve(cluster_13.geometry)
item_7 = ListItem(List=cluster_13.R_2, Index=-1, Wrap=True)
road_visualization = RoadVisualization(crv=flatten(crv_8), rate=num, d=filter_5, h=python_2.bit_h)  # -> out, a, b; inputs crv: list of Curve
# ---------- road_visualization: Python ----------
import rhinoscriptsyntax as rs

if accuracy is None: accuracy = 0.3
if h is None: h = 20
if accuracy == 0: accuracy = 0.1
pts = []
for i in range(len(crv)):
    crv_pts = rs.DivideCurveLength(crv[i], accuracy)
    end_pt = rs.CurveEndPoint(crv[i])
    pts.extend(crv_pts)
    if crv_pts[-1] != end_pt:
        pts.append(end_pt)



tmp = []
length = int(len(pts)*rate)
if length > 1:
    for k in range(length):
        tmp.append(pts[k])
    a = rs.AddPolyline(tmp)
    nozzle_plane = rs.CreatePlane(tmp[-1],
                                  rs.CreateVector(1,0,0),
                                  rs.CreateVector(0,1,0))
    b = rs.AddCylinder(nozzle_plane, int(h), int(d)/2, cap=True)
# ---------- end road_visualization ----------
material_11 = CreateMaterial(Diffuse=item_7, Specular=RGB(255, 255, 255), Emission=RGB(0, 0, 0), Transparency=0, Shine=0)
crv_9 = Curve(road_visualization.a)
brep = Brep(road_visualization.b)
preview_17 = CustomPreview(Geometry=[road_visualization.a, road_visualization.b], Material=material_11)

# ----
swatch_7 = ColourSwatch(SwatchColor=RGB(227, 34, 34))
swatch_8 = ColourSwatch(SwatchColor=RGB(13, 47, 217))
crvdir_6 = CurveDirectionDisplay(Curves=cluster_13.D, Color=swatch_7, Size=Slider(12, range=0..20))
crvdir_7 = CurveDirectionDisplay(Curves=cluster_13.L, Color=swatch_8, Size=Slider(12, range=0..20))
preview_18 = CustomPreview(Geometry=cluster_13.L_2, Material=ColourSwatch(SwatchColor=RGB(122, 24, 163)))
preview_19 = CustomPreview(Geometry=cluster_13.D, Material=swatch_7)
preview_20 = CustomPreview(Geometry=cluster_13.L_3, Material=ColourSwatch(SwatchColor=RGB(163, 24, 24)))
preview_21 = CustomPreview(Geometry=cluster_13.L, Material=swatch_8)
toggle_7 = GroupToggle(ToggleActive=False, ToggleVisible=True)  # disabled

remote_receiver = RemoteReceiver(remote_sender)
connected_2 = GetConnectedObjects(Objects=remote_receiver)
concat_6 = Concatenate(FragmentA=knob, FragmentC="-", FragmentB="1")
rename_2 = RenameObject(Objects=connected_2, Names=concat_6)

_1 = Text(remote_receiver)
bang = ExplodeTree(Data=_1)  # -> Branch0, Branch1
merge_14 = Merge(Data1=start_code, Data2=bang.Branch0, Data3=end_code)
lng_10 = ListLength(List=merge_14)
larger_5 = LargerThan(FirstNumber=lng_10, SecondNumber=6)  # -> LargerThan, OrEqualTo
filter_38 = StreamFilter(Gate=larger_5.LargerThan, Stream1=merge_14)
stream_code = FileCreator(name=panel_9, ext="tap", lines=filter_38, write=save, open_folder=open_folder, path=toolpath_streaming_folder)  # inputs lines: list, write: Boolean
#   port name: Desired file name.
# ---------- stream_code: Python ----------
#Tweaked by Siemen Cuypers / 2019

ghenv.Component.Name = "File Creator"

import rhinoscriptsyntax as rs
import Grasshopper as gh
import os
import time

# Set varible to desired folder path
def Export(ext):
    
    dir = path
    txt = name + "." + ext
    
    if dir:
        file=str(dir)+ '\\' + txt
    filePath = open(file, "w") # Open the file
    for line in lines: # Iterate through lines
        filePath.write(line + "\n") # Write separate lines
    filePath.close() # Close the file

if write:
    if path:
        Export(ext)
    else:
        msg = "Set directory path for streaming"
        ghenv.Component.AddRuntimeMessage(gh.Kernel.GH_RuntimeMessageLevel.Warning, msg)
else:
    msg = "Set 'write' to True for streaming"
    ghenv.Component.AddRuntimeMessage(gh.Kernel.GH_RuntimeMessageLevel.Warning, msg)
    
if open_folder:
    os.startfile(path)
# ---------- end stream_code ----------

_1_2 = Text(bang.Branch1)
unweave_6 = Unweave(List=_1_2, UnweavePattern=[0, 1, 2])  # -> Data0, Data1, Data2
weave_5 = Weave(Pattern=[0, 1], Stream0=unweave_6.Data1, Stream1=unweave_6.Data2, NullGaps=False)
ma_5 = MassAddition(Input=unweave_6.Data0)  # -> Result, PartialResults
join = TextJoin(Text=weave_5)

entwine_6 = Entwine(Branch00=format_12, Branch01=ma_5.Result, Branch02=join, FlattenInputs=True)
d1 = RemoteSender(entwine_6)
connected_3 = GetConnectedObjects(Objects=d1)
rename_3 = RenameObject(Objects=connected_3, Names=concat_5)

d1_2 = RemoteReceiver(d1)

# ---- group: Operation Description
merge_15 = Merge(
    Data1=flatten(d1_2),
    Data2=flatten(d2),
    Data3=flatten(d3),
    Data4=flatten(d4),
    Data5=flatten(d5),
    Data6=flatten(d6),
    Data7=flatten(d7),
    Data8=flatten(d8),
    Data9=flatten(d9),
    Data10=flatten(d10),
    Data11=flatten(d11),
    Data12=flatten(d12),
    Data13=flatten(d13))
unweave_7 = Unweave(List=merge_15, UnweavePattern=[0, 1, 2])  # -> Data0, Data1, Data2
split_2 = TextSplit(Text=unweave_7.Data0, Separators=".")
split_3 = SplitList(List=split_2, Index=1)  # -> flatten(ListA), flatten(ListB)
sort_3 = SortList(Keys=split_3.ListA, ValuesA=unweave_7.Data0, ValuesB=unweave_7.Data1)  # -> Keys, ValuesA, ValuesB
sort_4 = SortList(Keys=split_3.ListA, ValuesA=unweave_7.Data0, ValuesB=unweave_7.Data2)  # -> Keys, ValuesA, ValuesB
ma_6 = MassAddition(Input=unweave_7.Data1)  # -> Result, PartialResults
python_4 = GhPythonScript(x=ma_6.Result)  # -> a
# ---------- python_4: Python ----------
__author__ = "Saha"
__version__ = "2023.03.07"

import rhinoscriptsyntax as rs
import time

if x:
    a = time.strftime("%H:%M:%S", time.gmtime(x*60))
# ---------- end python_4 ----------
ins_4 = InsertItems(List=sort_3.ValuesA, Item="Total", Indices=-1, Wrap=True)
make_lenght_of_text_equal = MakeLenghtOfTextEqual(T=ins_4)

# ----
python_5 = GhPythonScript(x=sort_3.ValuesB)  # -> a; same code as python_4

number_slider_4 = Slider(50, range=0..1000)
division_5 = Division(A=number_slider_4, B=2)
offset_7 = OffsetCurve(Curve=filter_3, Distance=division_5, Corners=1)
offset_8 = OffsetCurve(Curve=brec.Bounding, Distance=number_slider_4, Corners=1)
graft_3 = GraftTree(Tree=filter_3, IncludeEmptyLists=True, IncludeNullItems=True)
brec_2 = BoundingRectangle(Geometry=offset_7, Plane=PlaneXY(0, 0, 0), Axis=0, Slide=0, Union=True)  # -> Bounding, DimensionX, DimensionY
brec_3 = BoundingRectangle(Geometry=graft_3, Plane=PlaneXY(0, 0, 0), Axis=0, Slide=0, Union=True)  # -> Bounding, DimensionX, DimensionY
number_slider_5 = Slider(76, range=0..100)
num_2 = Number(brec_3.DimensionX)
num_3 = Number(brec_3.DimensionY)
explode = Explode(Curve=brec_2.Bounding, Recursive=True)  # -> Segments, Vertices
brec_4 = BoundingRectangle(Geometry=offset_8, Plane=PlaneXY(0, 0, 0), Axis=0, Slide=0, Union=True)  # -> Bounding, DimensionX, DimensionY
explode_2 = Explode(Curve=brec_4.Bounding, Recursive=True)  # -> Segments, Vertices
shift = ShiftList(List=explode.Segments, Shift=1, Wrap=True)
item_8 = ListItem(List=explode_2.Segments, Index=0, Wrap=True)  # -> Item, Item1, Item2, Item3
explode_3 = Explode(Curve=brec_4.Bounding, Recursive=True)  # -> Segments, Vertices
midpt = CurveMiddle(Curve=item_8.Item1)
midpt_2 = CurveMiddle(Curve=shift)  # -> reverse(Midpoint)
midpt_3 = CurveMiddle(Curve=explode_3.Segments)  # -> reverse(Midpoint)
item_9 = ListItem(List=midpt_3, Index=0, Wrap=True)

# ---- group: Operation Description (continued)
ins_5 = InsertItems(List=python_5, Item=python_4, Indices=-1, Wrap=True)
format_13 = Format(Format="{0} | {1}", Culture=127, Data0=make_lenght_of_text_equal, Data1=ins_5)
weave_6 = Weave(Pattern=[0, 1], Stream0=format_13, Stream1=sort_4.ValuesB, NullGaps=False)  # -> graft(Weave)
join_2 = TextJoin(Text=format_13)
renumber_8 = RenumberPaths(Data=weave_6)
divide_branches = DivideBranches(DataTree=renumber_8, DivisionPattern=[0, 1], RenumberPaths=False)  # -> Data0, Data1

# ----
split_4 = TextSplit(Text=divide_branches.Data1)
len_3 = TextLength(Text=split_4)
cull_2 = CullPattern(List=split_4, CullPattern=len_3)
dispatch = Dispatch(List=simplify(cull_2), DispatchPattern=[True, False])  # -> ListA, ListB
lng_11 = ListLength(List=dispatch.ListB)
lng_12 = ListLength(List=dispatch.ListB)
series_3 = Series(Start=0, Step=1, Count=lng_11)
series_4 = Series(Start=0, Step=1, Count=lng_12)
replace = ReplaceItems(List=divide_branches.Data0, Item=ColourSwatch(SwatchColor=RGB(0, 72, 255)), Indices=0, Wrap=False)  # -> simplify(List)
replace_2 = ReplaceItems(List=divide_branches.Data0, Item=Slider(50, range=0..100), Indices=0, Wrap=False)  # -> simplify(List)
replace_3 = ReplaceItems(List=dispatch.ListB, Item=Slider(40, range=0..100), Indices=series_3, Wrap=False)  # -> simplify(List)
replace_4 = ReplaceItems(List=divide_branches.Data0, Item=Slider(0, range=0..100), Indices=0, Wrap=False)  # -> simplify(List)
replace_5 = ReplaceItems(List=dispatch.ListB, Item=Slider(35, range=0..100), Indices=series_4, Wrap=False)  # -> simplify(List)
merge_16 = Merge(Data1=replace, Data2=dispatch.ListB)
addition_5 = Addition(A=replace_2, B=Slider(10, range=0..100))
addition_6 = Addition(A=replace_3, B=Slider(10, range=0..100))
merge_17 = Merge(Data1=replace, Data2=dispatch.ListB)
merge_18 = Merge(Data1=replace_2, Data2=replace_3)
merge_19 = Merge(Data1=replace_4, Data2=replace_5)
merge_20 = Merge(Data1=addition_5, Data2=addition_6)
col = Colour(merge_16)
flatten_3 = FlattenTree(Tree=merge_20, Path="{0}")
ma_7 = MassAddition(Input=flatten(flatten_3))  # -> Result, PartialResults
unflatten = UnflattenTree(Tree=ma_7.PartialResults, Guide=merge_20)
pdecon_5 = Deconstruct(Point=midpt)  # -> XComponent, YComponent, ZComponent
neg_3 = Negative(Value=unflatten)
addition_7 = Addition(A=pdecon_5.YComponent, B=neg_3)
addition_8 = Addition(A=pdecon_5.XComponent, B=merge_19)
pt_6 = ConstructPoint(XCoordinate=addition_8, YCoordinate=addition_7, ZCoordinate=0)

lng_13 = ListLength(List=dispatch.ListB)
series_5 = Series(Start=0, Step=1, Count=lng_13)  # -> expr("x+1", Series)
concat_7 = Concatenate(FragmentC=series_5, FragmentA=".", FragmentB=dispatch.ListA)

merge_21 = Merge(Data1=divide_branches.Data0, Data2=simplify(concat_7))

number_slider_6 = Slider(8, range=0..10)
pdecon_6 = Deconstruct(Point=pt_6)  # -> XComponent, YComponent, ZComponent
cir_5 = Circle(Plane=wcs, Radius=Slider(10, range=0..10))
divide_2 = DivideCurve(Curve=cir_5, Count=4, Kinks=False)  # -> Points, Tangents, Parameters
divide_3 = DivideCurve(Curve=cir_5, Count=number_slider_6, Kinks=False)  # -> Points, Tangents, Parameters
dispatch_2 = Dispatch(List=divide_2.Points, DispatchPattern=[True, False])  # -> ListA, ListB
cull_i = CullIndex(List=midpt_2, Indices=-1, Wrap=True)
split_5 = TextSplit(Text=list, Separators="x")
dpipeline = DynamicGeometryPipeline(
    LayerFilter="Default",
    TypeFilter="Text",
    NameFilter="*",
    GroupByLayer=False,
    GroupByType=False,
    IncludeHidden=True,
    IncludeLocked=True,
    enableFullPath=False,
    listenToAttributes=True)
item_10 = ListItem(List=divide_3.Points, Index=expr("x+1", number_slider_6), Wrap=True)
pline = PolyLine(Vertices=dispatch_2.ListA, Closed=False)
pline_2 = PolyLine(Vertices=dispatch_2.ListB, Closed=False)
item_11 = ListItem(List=split_5, Index=0, Wrap=True)
lng_14 = ListLength(List=brec_2.Bounding)
id = CSharpScript(Blocks=dpipeline)  # -> GUID
# ---------- id: C# usings ----------
using System.IO;
using System.Linq;
using System.Data;
using System.Drawing;
using System.Reflection;
using System.Windows.Forms;
using System.Xml;
using System.Xml.Linq;
using System.Runtime.InteropServices;

using Rhino.DocObjects;
using Rhino.Collections;
using GH_IO;
using GH_IO.Serialization;
using Rhino.Runtime;
# ---------- id: C# ----------
    var block = Blocks as TextObject;
    GUID = block.Id;
# ---------- end id ----------
swatch_9 = ColourSwatch(SwatchColor=RGB(0, 255, 4))
swatch_10 = ColourSwatch(SwatchColor=RGB(255, 0, 0))
swatch_11 = ColourSwatch(SwatchColor=RGB(0, 38, 255))
dup = DuplicateData(Data=item_11, Number=lng_14, Order=True)
id_2 = Guid(dpipeline)
font = CreateGdiFont(Typeface="Cascadia Mono SemiBold", Size=merge_18, Bold=False, Italic=False)
preview_22 = CustomPreview(Geometry=pline, Material=swatch_9)
preview_23 = CustomPreview(Geometry=pline_2, Material=swatch_10)
preview_24 = CustomPreview(Geometry=cir_5, Material=swatch_11)
renumber_9 = RenumberPaths(Data=num_2)
renumber_10 = RenumberPaths(Data=num_3)
renumber_11 = RenumberPaths(Data=dup)
suirify = Suirify(dpipeline)
roundd = RoundToDecimalPlace(NumberX=renumber_9, DecimalPlace=1, RoundType=0)  # -> Rounded, Difference
roundd_2 = RoundToDecimalPlace(NumberX=renumber_10, DecimalPlace=1, RoundType=0)  # -> Rounded, Difference
merge_22 = Merge(Data1=simplify(roundd.Rounded), Data2=simplify(roundd_2.Rounded), Data3=simplify(renumber_11))
python_6 = PythonScript(id=id_2)  # -> out, text, plane, font, style, pt, fHeight, oPnts
# ---------- python_6: Python ----------
import rhinoscriptsyntax as rs
import Rhino as rc
import scriptcontext as sc
import Rhino.Geometry as rg

# Set the script context to the current Rhino doc
sc.doc = rc.RhinoDoc.ActiveDoc

# Do your Rhino doc business...
if id:
    tObj = rs.coercerhinoobject(id)
    text = tObj.DisplayText
    plane = tObj.Geometry.Plane
    font = rs.TextObjectFont(id)
    fHeight = rs.TextObjectHeight(id)
    style = rs.TextObjectStyle(id)
    pt = rs.TextObjectPoint(id)
    tPl = rs.TextObjectPlane(id)
    tTxtCrvs = rg.TextEntity.Explode(rs.coercegeometry(id))

    tTxtCrvsL = []
    for i in tTxtCrvs:
        tTxtCrvsL.append(i)

    tPnt  = rs.BoundingBox(tTxtCrvsL,tPl)
    oPnts = tPnt[0:4]
    
# Then set the script context back to the Grasshopper doc
sc.doc = ghdoc
# ---------- end python_6 ----------
rhatt_2 = GetRhinoAttributes(Geometry=filter_4)  # -> Name, Layer, Color
number_slider_7 = Slider(6, range=0..10)
incurves = PointInCurves(Point=python_6.pt, Curves=filter_3)  # -> Relationship, Index, Point
X = UnitX(Factor=1)
txt_2 = Text(rhatt_2.Color)
col_2 = Colour(rhatt_2.Color)
align = AlignPlane(Plane=python_6.plane, Direction=X)  # -> Plane, Angle
sift = SiftPattern(List=python_6.text, SiftPattern=incurves.Relationship)  # -> Output0, Output1, Output2
sift_2 = SiftPattern(List=python_6.pt, SiftPattern=incurves.Relationship)  # -> Output0, Output1, Output2
subtraction_4 = Subtraction(A=item_2.Item1, B=remap.Clipped)
sort_5 = SortList(Keys=txt_2, ValuesA=filter_4, ValuesB=col_2)  # -> Keys, ValuesA, ValuesB
font_2 = CreateGdiFont(Typeface="Cascadia Mono SemiBold", Size=Slider(30, range=0..50), Bold=invert(False), Italic=False)
font_3 = CreateGdiFont(Typeface=python_6.font, Size=python_6.fHeight, Bold=invert(False), Italic=False)
edge = CreateGdiEdge(Width=Slider(8, range=0..10), Colour=swatch, EndCap=2, DashCap=0)
edge_2 = CreateGdiEdge(Width=Slider(6, range=0..10), Colour=sort_5.ValuesB, EndCap=2, DashCap=0)
font_4 = CreateGdiFont(Typeface="Cascadia Mono SemiBold", Size=Slider(15, range=0..20), Bold=invert(False), Italic=False)
concat_8 = Concatenate(FragmentA="Z=", FragmentB=subtraction_4)
edge_3 = CreateGdiEdge(Width=number_slider_7, Colour=swatch_11, EndCap=0, DashCap=0)
edge_4 = CreateGdiEdge(Width=number_slider_7, Colour=swatch_10, EndCap=0, DashCap=0)
edge_5 = CreateGdiEdge(Width=number_slider_7, Colour=swatch_9, EndCap=0, DashCap=0)
panel_10 = Panel("""0
270
0""")
shape = CreateGdiShape(Geometry=filter_3, Edge=edge)
shape_2 = CreateGdiShape(Geometry=sort_5.ValuesA, Edge=edge_2)
shape_3 = CreateGdiShape(Geometry=pline, Edge=edge_4)
shape_4 = CreateGdiShape(Geometry=pline_2, Edge=edge_5)
shape_5 = CreateGdiShape(Geometry=cir_5, Edge=edge_3)
aligntext = CreateAlignedText(
    Text=concat_8,
    Font=font_4,
    Location=item_10,
    Colour=swatch_11,
    Horizontal=Slider(1.2, range=0..10),
    Vertical=0,
    Angle=degrees(0))
aligntext_2 = CreateAlignedText(Text=merge_22, Font=font_2, Location=cull_i, Colour=swatch, Horizontal=[0, 0, 0], Vertical=0, Angle=degrees(panel_10))
aligntext_3 = CreateAlignedText(
    Text=sift.Output2,
    Font=font_3,
    Location=sift_2.Output2,
    Colour=ColourSwatch(SwatchColor=RGB(0, 0, 0)),
    Horizontal=0,
    Vertical=0,
    Angle=align.Angle)
toolpath_streaming_folder_2 = FilePath("E:\Работа\Simple CNC Post TEST\")
null_9 = NullItem(Item=aligntext_3)  # -> NullFlags, InvalidFlags, Description
panel_11 = Panel("Cascadia Mono SemiBold")
concat_9 = Concatenate(FragmentA=toolpath_streaming_folder_2, FragmentB="Image", FragmentC=".png")
cull_3 = CullPattern(List=aligntext_3, CullPattern=invert(null_9.NullFlags))
toggle_8 = GroupToggle(ToggleActive=True, ToggleVisible=False)  # disabled

text = DefineTextObject(
    Text=merge_21,
    Plane=pt_6,
    DimensionStyle="Default",
    Justification="BottomLeft",
    Size=merge_18,
    Font="Cascadia Mono SemiBold",
    OutputType="Text")
preview_25 = CustomPreview(Geometry=text, Material=col)

# ---- group: Operation Description (continued)
brec_5 = BoundingRectangle(Geometry=flatten(text), Plane=PlaneXY(0, 0, 0), Axis=0, Slide=0, Union=True)  # -> Bounding, DimensionX, DimensionY
subtraction_5 = Subtraction(A=brec_5.DimensionX, B=Slider(150, range=0..1000))

# ----
addition_9 = Addition(A=brec_4.DimensionX, B=brec_5.DimensionX)
addition_10 = Addition(A=brec_5.DimensionY, B=Slider(50, range=0..1000))
division_6 = Division(A=addition_9, B=brec_4.DimensionX)
division_7 = Division(A=addition_10, B=brec_4.DimensionY)
eval_2 = Evaluate(F="if(x>1,x,1)", x=division_7)
scale_nu = ScaleNU(Geometry=brec_4.Bounding, Plane=item_9, ScaleX=division_6, ScaleY=eval_2, ScaleZ=1)  # -> Geometry, Transform

division_8 = Division(A=addition_10, B=2)
addition_11 = Addition(A=pdecon_6.YComponent, B=division_8)
pt_7 = ConstructPoint(XCoordinate=pdecon_6.XComponent, YCoordinate=addition_11, ZCoordinate=0)
aligntext_4 = CreateAlignedText(Text=merge_21, Font=font, Location=pt_7, Colour=col, Horizontal=Slider(1, range=0..10), Vertical=0, Angle=degrees(0))
merge_23 = Merge(
    Data1=shape,
    Data2=shape_2,
    Data3=shape_3,
    Data4=shape_4,
    Data5=shape_5,
    Data6=aligntext,
    Data8=cull_3,
    Data9=aligntext_2,
    Data10=flatten(aligntext_4))  # -> flatten(Result)
draw = DrawImage(
    Shapes=merge_23,
    Size=scale_nu.Geometry,
    Factor=Slider(2, range=0..10),
    Background=ColourSwatch(SwatchColor=RGB(150, 150, 150)),
    AntiAlias=True,
    FileLocation=concat_9)

# ==== cluster Cluster
crv = ClusterInput()
relay = ClusterInput()
relay_2 = ClusterInput()
crv_2 = Curve(crv)
Z = UnitZ(Factor=relay_2)
neg = Negative(Value=Z)
runion = RegionUnion(Curves=relay)
neg_2 = Negative(Value=relay_2)
extr = Extrude(Base=graft(runion), Direction=[Z, neg])
dom = ConstructDomain(DomainStart=neg_2, DomainEnd=relay_2)
boxrec = BoxRectangle(Rectangle=runion, Height=dom)
join = BrepJoin(Breps=extr)  # -> Breps, Closed
cap = CapHoles(Brep=join.Breps)
shapein = ShapeInBrep(Brep=cap, Shape=crv_2)
unweave = Unweave(List=crv_2, UnweavePattern=shapein)  # -> flatten(Data0), flatten(Data1), Data2
layertable = LayerTable(Update=True, AutoUpdate=invert(False))  # -> Layers, FullLayerPaths, LayerColors, Linetypes, MaterialNames, Visible, PrintWidth, PrintColor
clean = CleanTree(RemoveNulls=True, RemoveInvalid=True, RemoveEmpty=False, Tree=[unweave.Data0, unweave.Data1])
rhatt = GetRhinoAttributes(Geometry=clean)  # -> Name, Layer, Color
id = Guid(clean)
txt = Text(rhatt.Layer)
panel = Panel(id)
cset = CreateSet(List=txt)  # -> Set, Map
mindex = MemberIndex(Set=layertable.Layers, Member=cset.Set)  # -> flatten(Index), Count
tsort = SortText(Keys=cset.Set, Values=mindex.Index, Culture=127)  # -> Keys, Values
cset_2 = CreateSet(List=panel)  # -> Set, Map
T = ClusterOutput(clean)
L = ClusterOutput(layertable.Layers)
K = ClusterOutput(tsort.Keys)
V = ClusterOutput(tsort.Values)
panel_2 = Panel(mindex.Index)

# ==== cluster MakeLenghtOfTextEqual
T = ClusterInput()
len = TextLength(Text=T)
extremums = MinMax(Number=len)  # -> Minimum, Maximum
subtraction = Subtraction(A=extremums.Maximum, B=len)
dup = DuplicateData(Data=" ", Number=subtraction, Order=True)
join = TextJoin(Text=dup)
concat = Concatenate(FragmentA=graft(T), FragmentB=join)  # -> flatten(Result)
R = ClusterOutput(concat)

# ==== cluster Cluster_2
T = ClusterInput()
split = TextSplit(Text=T, Separators=",")
item = ListItem(List=split, Index=0, Wrap=True)  # -> Item, Item1
split_2 = TextSplit(Text=item.Item1, Separators="=")
item_2 = ListItem(List=split_2, Index=0, Wrap=True)  # -> Item, Item1
concat = Concatenate(FragmentA=item.Item, FragmentB=" ", FragmentC=item_2.Item1)  # -> flatten(Result)
R = ClusterOutput(concat)

# ==== cluster Cluster_3
category = ClusterInput()
G = ClusterInput()
area = Area(Geometry=G)  # -> Area, Centroid
division = Division(A=area.Area, B=1000000)
ma = MassAddition(Input=division)  # -> Result, PartialResults
roundd = RoundToDecimalPlace(NumberX=ma.Result, DecimalPlace=1, RoundType=0)  # -> Rounded, Difference
multiplication = Multiplication(A=category, B=250)
lng = ListLength(List=roundd.Rounded)
smaller = SmallerThan(FirstNumber=lng, SecondNumber=0)  # -> SmallerThan, OrEqualTo
filter = StreamFilter(Gate=smaller.SmallerThan, Stream1=category)
filter_2 = StreamFilter(Gate=smaller.SmallerThan)
multiplication_2 = Multiplication(A=multiplication, B=filter)
format = Format(Format="{0}{1}{2}", Culture=127, Data0=filter, Data1=filter_2, Data2=roundd.Rounded)
nullrep = ReplaceNulls(Items=format)  # -> Items, Count
clean = CleanTree(RemoveNulls=True, RemoveInvalid=True, RemoveEmpty=invert(False), Tree=format)
T = ClusterOutput(clean)

# ==== cluster STARTCODE

# ---- group: Delay (sec.)
sec = Slider(5, range=0..30)
multiplication = Multiplication(A=sec, B=1000)
format = Format(Format="G04 P{0}", Culture=127, Data0=multiplication)

# ---- group: Spindle Speed
format_2 = Format(Format="M3 S{0}", Culture=127, Data0=Slider(18000, range=1000..18000))

# ----
merge = Merge(Data1="G17 G40 G90 G21", Data2=format_2, Data3=format)
R = ClusterOutput(merge)

# ==== cluster ENDCODE
format = Format(Format="G53 X{0} Y{1} Z-10", Culture=127, Data0=Slider(140, range=0..10000), Data1=Slider(140, range=0..10000))
panel = Panel("""M5 M9
M30""")
ins = InsertItems(List=panel, Item=format, Indices=1, Wrap=True)  # -> flatten(List)
L = ClusterOutput(ins)

# ==== cluster Cluster_4
x = ClusterInput()
neg = Negative(Value=x)
G = ClusterInput()
A = ClusterInput()
A_2 = ClusterInput()
L = ClusterInput()
Z = UnitZ(Factor=neg)
division = Division(A=A_2, B=L)
move = Move(Geometry=G, Motion=Z)  # -> graft(Geometry), Transform
division_2 = Division(A=A, B=2)
repeat = RepeatData(Data=division, Length=L)
rad = Radians(Degrees=division_2)
ma = MassAddition(Input=repeat)  # -> Result, graft(PartialResults)
neg_2 = Negative(Value=ma.PartialResults)
Z_2 = UnitZ(Factor=neg_2)  # -> flatten(UnitVector)
tan = Tangent(Value=rad)
move_2 = Move(Geometry=move.Geometry, Motion=Z_2)  # -> Geometry, Transform
multiplication = Multiplication(A=ma.PartialResults, B=tan)
neg_3 = Negative(Value=multiplication)
offset = OffsetCurve(Curve=move_2.Geometry, Distance=flatten(neg_3), Corners=1)
number_slider = Slider(20, range=0..100)
shift = ShiftPaths(Data=offset, Offset=-1)
cull_i = CullIndex(List=shift, Indices=-1, Wrap=True)  # -> simplify(List)
item = ListItem(List=shift, Index=-1, Wrap=True)
pi = Pi(Factor=number_slider)
explode = Explode(Curve=move.Geometry, Recursive=True)  # -> simplify(graft(Segments)), Vertices
explode_2 = Explode(Curve=item, Recursive=True)  # -> simplify(graft(Segments)), Vertices
cull_i_2 = CullIndex(List=explode.Vertices, Indices=0, Wrap=True)
cull_i_3 = CullIndex(List=explode_2.Vertices, Indices=0, Wrap=True)
cir = Circle(Plane=cull_i_3, Radius=number_slider)
trim = TrimWithRegion(Curve=cir, Region=graft(item))  # -> Inside, Outside
len = Length(Curve=trim.Inside)
ln = Line(StartPoint=cull_i_3, EndPoint=cull_i_2)  # -> simplify(Line)
flip = FlipCurve(Curve=ln)  # -> Curve, Flag
ma_2 = MassAddition(Input=len)  # -> Result, PartialResult
shift_2 = ShiftPaths(Data=ma_2.Result, Offset=-1)
larger = LargerThan(FirstNumber=shift_2, SecondNumber=pi)  # -> graft(LargerThan), OrEqualTo
cull = CullPattern(List=graft(ln), CullPattern=invert(simplify(larger.LargerThan)))  # -> simplify(List)
cull_2 = CullPattern(List=graft(flip.Curve), CullPattern=invert(simplify(larger.LargerThan)))  # -> simplify(List)
merge = Merge(Data1=explode_2.Segments, Data2=cull, Data3=cull_2)
shift_3 = ShiftPaths(Data=merge, Offset=-1)
explode_3 = Explode(Curve=shift_3, Recursive=True)  # -> Segments, Vertices
shift_4 = ShiftPaths(Data=explode_3.Vertices, Offset=-1)
connect = ConnectCurves(Curves=shift_3, Continuity=2, Close=True, Bulge=1)
pline = PolyLine(Vertices=shift_4, Closed=False)  # -> simplify(Polyline)
renumber = RenumberPaths(Data=cull_i)
renumber_2 = RenumberPaths(Data=connect)
merge_2 = Merge(Data1=renumber, Data2=renumber_2)
loft = Loft(
    Curves=[move.Geometry, item],
    Options={Adjust=False, Closed=False, LoftEnds=0, LoftSimp=0, LoftType=0, Rebuild=10, Refit=0.01})
R = ClusterOutput(merge_2)
L_2 = ClusterOutput(loft)

# ==== cluster Cluster_5
enable = ClusterInput()
reset = ClusterInput()
d1 = ClusterInput()
G = ClusterInput()
L = ClusterInput()
i = ClusterInput()
L_2 = ClusterInput()
P = ClusterInput()
L_3 = ClusterInput()
A = ClusterInput()
lng = ListLength(List=L_2)
area = Area(Geometry=G)  # -> Area, Centroid
item = ListItem(List=L, Index=i, Wrap=True)
merge = Merge(Data1=d1, Data2=area.Centroid, Data3=item)  # -> simplify(graft(Result))
data_rec = PythonScript(x=merge, enable=enable, reset=reset, limit=lng)  # -> x; inputs x: tree, enable: Boolean, reset: Boolean, limit: Int32
# ---------- data_rec: Python ----------
from Grasshopper import DataTree
# if not enable : reset = True
if reset or 'rec' not in globals(): rec = DataTree[object]()
record = 0
if enable and not reset: rec.MergeTree(x)
if limit > 0:
    for branch in rec.Branches:
        if branch.Count > limit:
            branch.RemoveRange(0, branch.Count - limit)
x = rec
# ---------- end data_rec ----------
prune = PruneTree(Tree=data_rec, Minimum=1, Maximum=0)
cull_i = CullIndex(List=prune, Indices=Slider(1, range=0..1), Wrap=True)
flip_last = FlipLast(Data=prune)
item_2 = ListItem(List=simplify(flip_last), Index=0, Wrap=True)  # -> Item, Item1, Item2
tstat = TreeStatistics(Tree=item_2.Item1)  # -> Paths, Length, Count
addition = Addition(A=item_2.Item, B=1)
dpath = DeconstructPath(Branch=tstat.Paths)
addition_2 = Addition(A=dpath, B=1)
concat = Concatenate(FragmentA=addition_2, FragmentC="/", FragmentB=addition)
item_3 = ListItem(List=L_3, Index=flatten(item_2.Item), Wrap=True)
end = EndPoints(Curve=item_3)  # -> Start, End
lng_2 = ListLength(List=flatten(end.Start))
smaller = SmallerThan(FirstNumber=lng_2, SecondNumber=lng)  # -> SmallerThan, OrEqualTo
equals = Equality(FirstNumber=A, SecondNumber=6)  # -> Equality, Inequality
and = GateAnd(A=smaller.SmallerThan, B=equals.Equality)
textdot = DefineTextDot(Text=concat, Location=item_2.Item1, Font="Arial", Size=Slider(9, range=0..100))
textdot_2 = DefineTextDot(Text="Select all geometry!", Location=P, Font="Arial", Size=Slider(15, range=0..100))
T = ClusterOutput(textdot)
T_2 = ClusterOutput(textdot_2)
L_4 = ClusterOutput(lng)
R = ClusterOutput(and)
S = ClusterOutput(end.Start)

# ==== cluster Cluster_6
G = ClusterInput()
B = ClusterInput()
B_2 = ClusterInput()
Z = UnitZ(Factor=B)
move = Move(Geometry=G, Motion=Z)  # -> Geometry, Transform
flip = FlipCurve(Curve=move.Geometry)  # -> Curve, Flag
explode = Explode(Curve=flip.Curve, Recursive=True)  # -> Segments, Vertices
arc = CircularArc(explode.Segments)
null = NullItem(Item=arc)  # -> graft(NullFlags), InvalidFlags, Description
dispatch = Dispatch(List=graft(explode.Segments), DispatchPattern=null.NullFlags)  # -> ListA, ListB
prune = PruneTree(Tree=dispatch.ListA, Minimum=1, Maximum=0)
prune_2 = PruneTree(Tree=dispatch.ListB, Minimum=1, Maximum=0)

len = Length(Curve=explode.Segments)
len_2 = Length(Curve=flip.Curve)  # -> graft(Length)
ma = MassAddition(Input=len)  # -> Result, PartialResults
dom = ConstructDomain(DomainStart=0, DomainEnd=len_2)
dom_2 = ConstructDomain(DomainStart=0, DomainEnd=B)
remap = RemapNumbers(Value=ma.PartialResults, Source=dom, Target=dom_2)  # -> Mapped, Clipped
Z_2 = UnitZ(Factor=remap.Mapped)
end = EndPoints(Curve=explode.Segments)  # -> Start, End
neg = Negative(Value=Z_2)
move_2 = Move(Geometry=end.End, Motion=neg)  # -> Geometry, Transform
item = ListItem(List=end.Start, Index=0, Wrap=True)
ins = InsertItems(List=move_2.Geometry, Item=item, Indices=0, Wrap=True)
cull_i = CullIndex(List=ins, Indices=-1, Wrap=True)
ln = Line(StartPoint=cull_i, EndPoint=move_2.Geometry)  # -> simplify(graft(Line))

devec = DeconstructVector(Vector=explode.Segments)  # -> XComponent, YComponent, ZComponent
equals = Equality(FirstNumber=devec.ZComponent, SecondNumber=1)  # -> Equality, Inequality
sift = SiftPattern(List=explode.Segments, SiftPattern=equals.Equality)  # -> Output0, Output1
weave = Weave(Pattern=simplify(equals.Equality), Stream0=simplify(ln), Stream1=simplify(sift.Output1), NullGaps=False)
null_2 = NullItem(Item=ln)  # -> NullFlags, InvalidFlags, Description
cull = CullPattern(List=ln, CullPattern=invert(null_2.InvalidFlags))
cull_2 = CullPattern(List=ln, CullPattern=invert(null.NullFlags))
cull_3 = CullPattern(List=ln, CullPattern=null.NullFlags)
panel = Panel(weave)
end_2 = EndPoints(Curve=cull_2)  # -> Start, End
prune_3 = PruneTree(Tree=cull_3, Minimum=1, Maximum=0)
prune_4 = PruneTree(Tree=end_2.Start, Minimum=1, Maximum=0)

divide = DivideCurve(Curve=prune_2, Count=Slider(8, range=0..50), Kinks=False)  # -> Points, Tangents, Parameters
shift = ShiftPaths(Data=divide.Parameters, Offset=-1)
shatter = Shatter(Curve=prune_2, Parameters=shift)
shift_2 = ShiftPaths(Data=shatter, Offset=-1)
merge = Merge(Data1=prune, Data2=shift_2)
shift_3 = ShiftPaths(Data=merge, Offset=-1)
len_3 = Length(Curve=shift_3)
lng = ListLength(List=merge)
shift_4 = ShiftPaths(Data=lng, Offset=-1)
ma_2 = MassAddition(Input=len_3)  # -> Result, PartialResults
dom_3 = ConstructDomain(DomainStart=0, DomainEnd=B)
remap_2 = RemapNumbers(Value=ma_2.PartialResults, Source=dom, Target=dom_3)  # -> Mapped, Clipped
end_3 = EndPoints(Curve=shift_3)  # -> Start, End
Z_3 = UnitZ(Factor=remap_2.Mapped)
neg_2 = Negative(Value=Z_3)
move_3 = Move(Geometry=end_3.End, Motion=neg_2)  # -> Geometry, Transform
partition = PartitionList(List=move_3.Geometry, Size=shift_4)
dispatch_2 = Dispatch(List=partition, DispatchPattern=null.NullFlags)  # -> ListA, ListB
prune_5 = PruneTree(Tree=dispatch_2.ListB, Minimum=1, Maximum=0)
ins_2 = InsertItems(List=prune_5, Item=prune_4, Indices=0, Wrap=True)

item_2 = ListItem(List=end_3.Start, Index=0, Wrap=True)

lng_2 = ListLength(List=ins_2)
division = Division(A=lng_2, B=3)
round = Round(Number=division)  # -> Nearest, Floor, Ceiling
series = Series(Start=2, Step=2, Count=round.Floor)
item_3 = ListItem(List=ins_2, Index=series, Wrap=invert(True))
ins_3 = InsertItems(List=ins_2, Item=item_3, Indices=series, Wrap=True)
partition_2 = PartitionList(List=ins_3, Size=3)
item_4 = ListItem(List=partition_2, Index=0, Wrap=True)  # -> Item, Item1, Item2
arc_2 = Arc3Pt(PointA=item_4.Item, PointB=item_4.Item1, PointC=item_4.Item2)  # -> Arc, Plane, Radius
len_4 = Length(Curve=arc_2.Arc)
equals_2 = Equality(FirstNumber=len_4, SecondNumber=0)  # -> Equality, Inequality
cull_4 = CullPattern(List=arc_2.Arc, CullPattern=invert(equals_2.Equality))
shift_5 = ShiftPaths(Data=cull_4, Offset=-1)

tstat = TreeStatistics(Tree=shift_5)  # -> Paths, Length, Count
tstat_2 = TreeStatistics(Tree=prune_4)  # -> Paths, Length, Count
replace = ReplacePaths(Data=shift_5, Search=tstat.Paths, Replace=tstat_2.Paths)
merge_2 = Merge(Data1=prune_3, Data2=replace)
shift_6 = ShiftPaths(Data=merge_2, Offset=-1)
join = JoinCurves(Curves=shift_6, Preserve=False)
C = ClusterOutput(join)

# ==== cluster Cluster_7
T = ClusterInput()
tstat = TreeStatistics(Tree=T)  # -> Paths, Length, Count
item = ListItem(List=tstat.Paths, Index=0, Wrap=True)
dpath = DeconstructPath(Branch=item)
lng = ListLength(List=dpath)
subtraction = Subtraction(A=lng, B=Slider(1, range=0..1))
neg = Negative(Value=subtraction)
shift = ShiftPaths(Data=T, Offset=neg)
D = ClusterOutput(shift)

# ==== cluster Cluster_8
C = ClusterInput()
explode = Explode(Curve=C, Recursive=True)  # -> Segments, Vertices
len = Length(Curve=explode.Segments)
division = Division(A=len, B=Slider(121, range=1..500))
divide = DivideCurve(Curve=explode.Segments, Count=division, Kinks=False)  # -> Points, Tangents, Parameters
P = ClusterOutput(divide.Points)
shatter = Shatter(Curve=graft(explode.Segments), Parameters=divide.Parameters)
end = EndPoints(Curve=shatter)  # -> Start, End
vec2pt = Vector2Pt(PointA=end.Start, PointB=end.End, Unitize=False)  # -> Vector, Length
align = AlignPlane(Plane=divide.Points, Direction=vec2pt.Vector)  # -> Plane, Angle
cf = ClusterInput()
ce = ClusterInput()
symadv = SymbolAdvanced(
    Style=Slider(9, range=0..20),
    SizePrimary=Slider(2, range=0..10),
    SizeSecondary=Slider(0, range=0..10),
    Rotation=align.Angle,
    Fill=cf,
    Edge=ce,
    Width=2,
    Adjust=False)
D = ClusterOutput(symadv)

# ==== cluster Cluster_9
C = ClusterInput()
explode = Explode(Curve=C, Recursive=True)  # -> Segments, Vertices
python = GhPythonScript(segments=explode.Segments)  # -> out, lines_arcs
# ---------- python: Python ----------
__author__ = "Saha"
__version__ = "2023.04.21"

import rhinoscriptsyntax as rs

if segments:
    try:
        lines_arcs = rs.IsArc(segments) or rs.IsLine(segments)
    except:
        lines_arcs = False
# ---------- end python ----------
unweave = Unweave(List=explode.Segments, UnweavePattern=python.lines_arcs)  # -> Data0, Data1
curve_to_arcs_and_lines = CurveToArcsAndLines(C=unweave.Data0)
weave = Weave(Pattern=python.lines_arcs, Stream0=curve_to_arcs_and_lines, Stream1=unweave.Data1, NullGaps=False)
shift = ShiftPaths(Data=weave, Offset=-1)
join = JoinCurves(Curves=shift, Preserve=False)
connect = ConnectCurves(Curves=weave, Continuity=0, Close=invert(True), Bulge=1)
shift_2 = ShiftPaths(Data=join, Offset=-1)
shift_3 = ShiftPaths(Data=connect, Offset=-1)
null = NullItem(Item=shift_3)  # -> NullFlags, InvalidFlags, Description
weave_2 = Weave(Pattern=null.InvalidFlags, Stream0=shift_3, Stream1=shift_2, NullGaps=False)
W = ClusterOutput(weave_2)

# ==== cluster SortGroups
T = ClusterInput()
tstat = TreeStatistics(Tree=T)  # -> Paths, Length, Count
larger = LargerThan(FirstNumber=tstat.Length, SecondNumber=1)  # -> graft(LargerThan), OrEqualTo
unweave = Unweave(List=T, UnweavePattern=larger.LargerThan)  # -> Data0, Data1
item = ListItem(List=unweave.Data1, Index=0, Wrap=True)  # -> simplify(Item)
cull_i = CullIndex(List=unweave.Data1, Indices=0, Wrap=True)  # -> simplify(List)
split = SplitList(List=unweave.Data1, Index=1)  # -> ListA, ListB
shift = ShiftPaths(Data=cull_i, Offset=-1)
cluster = Cluster_7(T=split.ListA)
sort_crv = SortByCurve(Curves=cull_i, Guide=item, Parameter=0.5)  # -> Curves, Indices
cluster_2 = Cluster_7(T=sort_crv.Curves)
shift_2 = ShiftPaths(Data=sort_crv.Curves, Offset=-1)
merge = Merge(Data1=simplify(item), Data2=simplify(shift_2))
weave = Weave(Pattern=larger.LargerThan, Stream0=unweave.Data0, Stream1=split.ListA, NullGaps=False)
weave_2 = Weave(Pattern=larger.LargerThan, Stream0=unweave.Data0, Stream1=merge, NullGaps=False)
end = EndPoints(Curve=flatten(weave))  # -> Start, End
W = ClusterOutput(weave_2)
S = ClusterOutput(end.Start)

# ==== cluster CenterBetweenPts
L = ClusterInput()
lng = ListLength(List=L)
larger = LargerThan(FirstNumber=lng, SecondNumber=2)  # -> LargerThan, OrEqualTo
gate = StreamGate(Stream=L, Gate=larger.LargerThan)  # -> Target0, Target1
dispatch = Dispatch(List=gate.Target0, DispatchPattern=[True, False])  # -> ListA, ListB
hull = ConvexHull(Points=gate.Target1, Plane=PlaneXY(0, 0, 0))  # -> Hull, HullZ, Indices
ln = Line(StartPoint=dispatch.ListA, EndPoint=dispatch.ListB)
midpt = CurveMiddle(Curve=ln)
area = Area(Geometry=hull.Hull)  # -> Area, Centroid
filter = StreamFilter(Gate=larger.LargerThan, Stream0=midpt, Stream1=area.Centroid)
center = ClusterOutput(filter)

# ==== cluster Cluster_14
cut_feedrate = ClusterInput()
engage_feedrate = ClusterInput()
number_slider = Slider(3, range=0..5)
C = ClusterInput()
C_2 = ClusterInput()
d2 = ClusterInput()
layercolor = ClusterInput()
x0 = ClusterInput()
y0 = ClusterInput()
Z = ClusterInput()
pt = ConstructPoint(XCoordinate=x0, YCoordinate=y0, ZCoordinate=Z)
A = ClusterInput()
B = ClusterInput()
end = EndPoints(Curve=C)  # -> Start, End
pdecon = Deconstruct(Point=end.Start)  # -> XComponent, YComponent, ZComponent

clean = CleanTree(RemoveNulls=True, RemoveInvalid=True, RemoveEmpty=False, Tree=flatten(C))  # -> simplify(graft(Tree))
renumber = RenumberPaths(Data=clean)
explode = Explode(Curve=renumber, Recursive=True)  # -> Segments, Vertices
arc = CircularArc(explode.Segments)
null = NullItem(Item=arc)  # -> NullFlags, InvalidFlags, Description
dispatch = Dispatch(List=graft(explode.Segments), DispatchPattern=graft(null.NullFlags))  # -> ListA, ListB
prune = PruneTree(Tree=dispatch.ListA, Minimum=1, Maximum=0)
prune_2 = PruneTree(Tree=dispatch.ListB, Minimum=1, Maximum=0)
lines_to_g_code = LinesToGCODE(C=prune, D=engage_feedrate, d=number_slider, x0=x0, y0=y0)
cluster = Cluster_13(crv=prune_2, D=engage_feedrate, d=number_slider, x0=x0, y0=y0)
merge = Merge(Data1=lines_to_g_code, Data2=cluster)
cluster_2 = Cluster_7(T=merge)

clean_2 = CleanTree(RemoveNulls=True, RemoveInvalid=True, RemoveEmpty=False, Tree=flatten(C_2))  # -> simplify(graft(Tree))
renumber_2 = RenumberPaths(Data=clean_2)
explode_2 = Explode(Curve=renumber_2, Recursive=True)  # -> Segments, Vertices
arc_2 = CircularArc(explode_2.Segments)
null_2 = NullItem(Item=arc_2)  # -> NullFlags, InvalidFlags, Description
dispatch_2 = Dispatch(List=graft(explode_2.Segments), DispatchPattern=graft(null_2.NullFlags))  # -> ListA, ListB
prune_3 = PruneTree(Tree=dispatch_2.ListA, Minimum=1, Maximum=0)
prune_4 = PruneTree(Tree=dispatch_2.ListB, Minimum=1, Maximum=0)
lines_to_g_code_2 = LinesToGCODE(C=prune_3, D=cut_feedrate, d=number_slider, x0=x0, y0=y0)
cluster_3 = Cluster_13(crv=prune_4, D=cut_feedrate, d=number_slider, x0=x0, y0=y0)
merge_2 = Merge(Data1=lines_to_g_code_2, Data2=cluster_3)
cluster_4 = Cluster_7(T=merge_2)

pt_2 = ConstructPoint(XCoordinate=pdecon.XComponent, YCoordinate=pdecon.YComponent, ZCoordinate=Z)
shift = ShiftList(List=pt_2, Shift=1, Wrap=True)
item = ListItem(List=pt_2, Index=0, Wrap=True)  # -> simplify(Item)
pt_3 = Point(item)
ln = Line(StartPoint=pt_2, EndPoint=end.Start)
ln_2 = Line(StartPoint=A, EndPoint=B)
null_3 = NullItem(Item=ln)  # -> NullFlags, InvalidFlags, Description
null_4 = NullItem(Item=ln_2)  # -> NullFlags, InvalidFlags, Description
cull = CullPattern(List=ln, CullPattern=invert(null_3.NullFlags))
cull_2 = CullPattern(List=ln_2, CullPattern=invert(null_4.NullFlags))
end_2 = EndPoints(Curve=cull_2)  # -> Start, End
ln_3 = Line(StartPoint=end_2.End, EndPoint=shift)
cull_i = CullIndex(List=ln_3, Indices=-1, Wrap=True)  # -> simplify(List)
item_2 = ListItem(List=cull_2, Index=-1, Wrap=True)
end_3 = EndPoints(Curve=item_2)  # -> Start, End
pt_4 = Point(end_3.End)
weave = Weave(Pattern=[0, 1], Stream0=pt_3, Stream1=pt_4, NullGaps=False)
entwine = Entwine(Branch00=pt, Branch01=weave, FlattenInputs=True)  # -> flatten(Result)
partition = PartitionList(List=entwine, Size=2)
dispatch_3 = Dispatch(List=partition, DispatchPattern=[True, False])  # -> ListA, ListB
ln_4 = Line(StartPoint=dispatch_3.ListA, EndPoint=dispatch_3.ListB)
cluster_5 = Cluster_11(C=cull, B=engage_feedrate, d=number_slider, x0=x0, y0=y0)  # -> C_2, i
prune_5 = PruneTree(Tree=ln_4, Minimum=1, Maximum=0)
renumber_3 = RenumberPaths(Data=prune_5)
cluster_6 = Cluster_10(C=cull_2, L=cluster_5.i, d=number_slider, x0=x0, y0=y0)
renumber_4 = RenumberPaths(Data=cull_i)
renumber_5 = RenumberPaths(Data=cull_2)
merge_3 = Merge(Data1=renumber_3, Data2=renumber_4, Data3=renumber_5)
prune_6 = PruneTree(Tree=merge_3, Minimum=1, Maximum=0)
panel = Panel(cluster_2)
panel_2 = Panel(cluster_4)
panel_3 = Panel(cluster_6)
panel_4 = Panel(cluster_5.C_2)
graft = GraftTree(Tree=cull, IncludeEmptyLists=True, IncludeNullItems=True)
graft_2 = GraftTree(Tree=cull_2, IncludeEmptyLists=True, IncludeNullItems=True)
renumber_6 = RenumberPaths(Data=panel_4)
renumber_7 = RenumberPaths(Data=panel)
renumber_8 = RenumberPaths(Data=panel_2)
renumber_9 = RenumberPaths(Data=panel_3)
renumber_10 = RenumberPaths(Data=graft)
renumber_11 = RenumberPaths(Data=graft_2)
L = ClusterOutput(cull_2)
L_2 = ClusterOutput(cull)
L_3 = ClusterOutput(cull_i)
D = ClusterOutput(renumber_3)
merge_4 = Merge(Data1=renumber_10, Data2=renumber, Data3=renumber_2, Data4=renumber_11)
merge_5 = Merge(Data1=renumber_6, Data2=renumber_7, Data3=renumber_8, Data4=renumber_9)
geometry = ClusterOutput(merge_4)
R = ClusterOutput(merge_5)
len = Length(Curve=C_2)  # -> flatten(Length)
len_2 = Length(Curve=merge_3)  # -> flatten(Length)
len_3 = Length(Curve=C)  # -> flatten(Length)
len_4 = Length(Curve=cull)  # -> flatten(Length)
ma = MassAddition(Input=len)  # -> Result, PartialResults
ma_2 = MassAddition(Input=len_2)  # -> Result, PartialResults
ma_3 = MassAddition(Input=len_3)  # -> Result, PartialResults
ma_4 = MassAddition(Input=len_4)  # -> Result, PartialResults
division = Division(A=ma.Result, B=cut_feedrate)
division_2 = Division(A=ma_2.Result, B=Slider(10000, range=0..100000))
division_3 = Division(A=ma_3.Result, B=engage_feedrate)
division_4 = Division(A=ma_4.Result, B=engage_feedrate)
panel_5 = Panel(ma_2.Result)
panel_6 = Panel(ma_3.Result)
panel_7 = Panel(ma_4.Result)
panel_8 = Panel(ma.Result)
merge_6 = Merge(Data1=division, Data2=division_2, Data3=division_3, Data4=division_4)
renumber_12 = RenumberPaths(Data=layercolor)
ma_5 = MassAddition(Input=merge_6)  # -> Result, PartialResults
merge_7 = Merge(Data1=ma_5.Result, Data2=d2, Data3=renumber_12)
R_2 = ClusterOutput(merge_7)

# ==== cluster Pocketing
A = ClusterInput()
_1 = ClusterInput()
_1_2 = ClusterInput()
equals = Equality(FirstNumber=A, SecondNumber=3)  # -> Equality, Inequality
cf = ClusterInput()
of = ClusterInput()
cut_direction = ClusterInput()
A_2 = ClusterInput()
clean_islands = ClusterInput()
bit_dia = ClusterInput()
D = ClusterInput()
filter = StreamFilter(Gate=equals.Equality, Stream1=_1)
graft = GraftTree(Tree=filter, IncludeEmptyLists=True, IncludeNullItems=True)
cluster = Cluster_17(C=graft, D=A_2)
c2offset = Clipper2Offset(Polylines=filter, Distance=bit_dia, JoinType=cf, EndType=of, MiterLimit=2, Precision=4, SVGHeight=600, SVGWidth=800)  # -> Holes, Outer, ClipperPath
polyboolean = PolylineBoolean(
    A=c2offset.Holes,
    B=c2offset.Outer,
    BooleanType=0,
    Plane=Plane(origin=(0, 0, 0), x=(0, 0, 0), y=(0, 0, 0)),
    Tolerance=0.001,
    EvenOdd=True)
T = ClusterInput()

number_slider = Slider(0, range=0..360)  # disabled
xy = XYPlane(Origin=Point(0, 0, 0))  # disabled
rad = Radians(Degrees=number_slider)  # disabled
number_slider_2 = Slider(10, range=0..10)  # disabled
prot = RotatePlane(Plane=xy, Angle=rad)  # disabled
Z = UnitZ(Factor=number_slider_2)  # disabled
Z_2 = UnitZ(Factor=number_slider_2)  # disabled
neg = Negative(Value=Z_2)  # disabled
number_slider_3 = Slider(100, range=0..100)  # disabled

polyoffset = PolylineOffset(
    Polylines=filter,
    Distance=bit_dia,
    Plane=Plane(origin=(0, 0, 0), x=(0, 0, 0), y=(0, 0, 0)),
    Tolerance=0.001,
    ClosedFillet=cf,
    OpenFillet=of,
    Miter=0)  # -> Contour, simplify(Holes)
polyboolean_2 = PolylineBoolean(
    A=polyoffset.Contour,
    B=polyoffset.Holes,
    BooleanType=0,
    Plane=Plane(origin=(0, 0, 0), x=(0, 0, 0), y=(0, 0, 0)),
    Tolerance=0.001,
    EvenOdd=True)

graft_2 = GraftTree(Tree=polyboolean_2, IncludeEmptyLists=True, IncludeNullItems=True)
cluster_2 = Cluster_7(T=graft_2)

polyoffset_2 = PolylineOffset(
    Polylines=cluster_2,
    Distance=A_2,
    Plane=Plane(origin=(0, 0, 0), x=(0, 0, 0), y=(0, 0, 0)),
    Tolerance=0.001,
    ClosedFillet=cf,
    OpenFillet=of,
    Miter=0)  # -> Contour, simplify(Holes); disabled
polyboolean_3 = PolylineBoolean(
    A=polyoffset_2.Contour,
    B=polyoffset_2.Holes,
    BooleanType=0,
    Plane=Plane(origin=(0, 0, 0), x=(0, 0, 0), y=(0, 0, 0)),
    Tolerance=0.001,
    EvenOdd=True)  # disabled
cluster_3 = Cluster_7(T=polyboolean_3)  # disabled
brec = BoundingRectangle(Geometry=cluster_3, Plane=prot, Axis=0, Slide=0, Union=True)  # -> Bounding, DimensionX, DimensionY; disabled
boundary = BoundarySurfaces(Edges=cluster_3)  # disabled
end = EndPoints(Curve=brec.Bounding)  # -> Start, End; disabled
extr = Extrude(Base=boundary, Direction=[Z, neg])  # disabled
xy_2 = XYPlane(Origin=end.Start)  # disabled
sunion = SolidUnion(Breps=extr)  # disabled
prot_2 = RotatePlane(Plane=xy_2, Angle=rad)  # disabled
division = Division(A=brec.DimensionX, B=A_2)  # disabled
recgrid = Rectangular(Plane=prot_2, SizeX=A_2, SizeY=brec.DimensionY, ExtentX=division, ExtentY=1)  # -> simplify(Cells), Points; disabled
explode = Explode(Curve=recgrid.Cells, Recursive=True)  # -> Segments, Vertices; disabled
dispatch = Dispatch(List=explode.Segments, DispatchPattern=[True, False])  # -> ListA, ListB; disabled
shift = ShiftPaths(Data=dispatch.ListB, Offset=-3)  # disabled
dup_lines = CleanDuplicateLines(Lines=shift, Tolerance=0.01)  # -> simplify(Lines), Indices, Status; disabled
srfsplit = SurfaceSplit(Surface=boundary, Curves=dup_lines.Lines)  # disabled
trim = TrimWithBrep(Curve=dup_lines.Lines, Brep=sunion)  # -> Inside, Outside; disabled
crv = Curve(trim.Inside)  # disabled
explode_2 = Explode(Curve=brec.Bounding, Recursive=True)  # -> Segments, Vertices; disabled
shift_2 = ShiftPaths(Data=simplify(crv), Offset=-1)  # disabled
item = ListItem(List=explode_2.Segments, Index=0, Wrap=True)  # disabled
shift_3 = ShiftPaths(Data=recgrid.Cells, Offset=-2)  # disabled
sortc = SortCurvesAlongCrv(Curves=shift_2, GuideCrv=item, CrvParam=0.5)  # -> simplify(SortedCurves), CurveIndex; disabled
trim_2 = TrimWithRegions(Curve=cluster_3, Regions=sortc.SortedCurves)  # -> Inside, simplify(Outside); disabled
dispatch_2 = Dispatch(List=trim_2.Outside, DispatchPattern=[True, False])  # -> ListA, ListB; disabled
len = Length(Curve=trim_2.Outside)  # disabled
weave = Weave(Pattern=[0, 1], Stream0=sortc.SortedCurves, Stream1=dispatch_2.ListA, NullGaps=False)  # disabled
smaller = SmallerThan(FirstNumber=len, SecondNumber=number_slider_3)  # -> SmallerThan, OrEqualTo; disabled
panel = Panel(len)  # disabled
cull = CullPattern(List=trim_2.Outside, CullPattern=smaller.SmallerThan)  # disabled

c2offset_2 = Clipper2Offset(Polylines=cluster_2, Distance=cluster, JoinType=cf, EndType=of, MiterLimit=0, Precision=4, SVGHeight=600, SVGWidth=800)  # -> Holes, Outer, ClipperPath

polyoffset_3 = PolylineOffset(
    Polylines=simplify(cluster_2),
    Distance=cluster,
    Plane=Plane(origin=(0, 0, 0), x=(0, 0, 0), y=(0, 0, 0)),
    Tolerance=0.001,
    ClosedFillet=cf,
    OpenFillet=of,
    Miter=0)  # -> Contour, simplify(Holes); disabled
polyboolean_4 = PolylineBoolean(
    A=polyoffset_3.Contour,
    B=polyoffset_3.Holes,
    BooleanType=0,
    Plane=Plane(origin=(0, 0, 0), x=(0, 0, 0), y=(0, 0, 0)),
    Tolerance=0.001,
    EvenOdd=True)  # disabled

polyboolean_5 = PolylineBoolean(
    A=c2offset_2.Holes,
    B=c2offset_2.Outer,
    BooleanType=0,
    Plane=Plane(origin=(0, 0, 0), x=(0, 0, 0), y=(0, 0, 0)),
    Tolerance=0.001,
    EvenOdd=True)
cluster_4 = Cluster_7(T=polyboolean_5)
group_geo_in_geo = GroupGeoInGeo(G=filter, S=cluster_4)
cluster_5 = Cluster_7(T=group_geo_in_geo)
merge = Merge(Data1=cluster_2, Data2=cluster_5)

cir = Circle(Plane=PlaneXY(0, 0, 0), Radius=1)
flip = FlipCurve(Curve=cir)  # -> Curve, Flag
filter_2 = StreamFilter(Gate=cut_direction, Stream0=flip.Curve, Stream1=cir)
flip_2 = FlipCurve(Curve=merge, Guide=graft(filter_2))  # -> Curve, Flag

graft_3 = GraftTree(Tree=flip_2.Curve, IncludeEmptyLists=True, IncludeNullItems=True)
pocket_clean_islands = PocketCleanIslands(G=clean_islands, P=graft_3, D=bit_dia, crv=cluster_2)
connect = Connect(A=cluster_2, A_2=A_2, B=pocket_clean_islands)
cluster_6 = GroupGeoInGeo(G=filter, S=flatten(connect))
cluster_7 = Cluster_7(T=cluster_6)
shift_4 = ShiftPaths(Data=cluster_6, Offset=-1)

polyoffset_4 = PolylineOffset(
    Polylines=cluster_6,
    Distance=bit_dia,
    Plane=Plane(origin=(0, 0, 0), x=(0, 0, 0), y=(0, 0, 0)),
    Tolerance=0.001,
    ClosedFillet=0,
    OpenFillet=1,
    Miter=2)  # -> Contour, Holes
move = Move(Geometry=shift_4, Motion=T)  # -> Geometry, Transform
polyboolean_6 = PolylineBoolean(
    A=polyoffset_4.Contour,
    B=polyoffset_4.Holes,
    BooleanType=2,
    Plane=Plane(origin=(0, 0, 0), x=(0, 0, 0), y=(0, 0, 0)),
    Tolerance=0.001,
    EvenOdd=True)
boundary_2 = BoundarySurfaces(Edges=polyboolean_6)

polyoffset_5 = PolylineOffset(
    Polylines=polyoffset_4.Holes,
    Distance=Slider(0.1, range=0..1),
    Plane=Plane(origin=(0, 0, 0), x=(0, 0, 0), y=(0, 0, 0)),
    Tolerance=0.001,
    ClosedFillet=0,
    OpenFillet=1,
    Miter=2)  # -> Contour, Holes
crv_2 = Curve(simplify(polyoffset_5.Holes))
boundary_3 = BoundarySurfaces(Edges=crv_2)
S = ClusterOutput(boundary_2)
A_3 = ClusterOutput(cluster_6)
G = ClusterOutput(move.Geometry)
crv_3 = ClusterOutput(crv_2)
S_2 = ClusterOutput(boundary_3)

# ==== cluster ShortestWalk
G = ClusterInput()
flatten = FlattenTree(Tree=G, Path="{0}")
cls = Closed(Curve=flatten)  # -> Closed, Periodic
unweave = Unweave(List=flatten, UnweavePattern=cls.Closed)  # -> Data0, Data1
end = EndPoints(Curve=flatten(unweave.Data1))  # -> Start, End
crossref = CrossReference(ListA=end.Start, ListB=end.End, CrossMode=1)  # -> ListA, ListB
ln = Line(StartPoint=crossref.ListA, EndPoint=crossref.ListB)
shortwalk = ShortestWalk(Curves=flatten(ln), WantedPath=unweave.Data1)  # -> ShortestWalk, Succession, Direction, Length
weave = Weave(Pattern=cls.Closed, Stream0=unweave.Data0, Stream1=unweave.Data1, NullGaps=False)
unflatten = UnflattenTree(Tree=weave, Guide=G)
T = ClusterOutput(unflatten)

# ==== cluster SortGroups_2
T = ClusterInput()
tstat = TreeStatistics(Tree=T)  # -> Paths, Length, Count
larger = LargerThan(FirstNumber=tstat.Length, SecondNumber=1)  # -> graft(LargerThan), OrEqualTo
unweave = Unweave(List=T, UnweavePattern=larger.LargerThan)  # -> Data0, Data1
item = ListItem(List=unweave.Data1, Index=0, Wrap=True)  # disabled
cull_i = CullIndex(List=unweave.Data1, Indices=0, Wrap=True)  # disabled
split = SplitList(List=unweave.Data1, Index=1)  # -> ListA, ListB
sort_crv = SortByCurve(Curves=split.ListB, Guide=split.ListA, Parameter=0.5)  # -> Curves, Indices
shift = ShiftPaths(Data=sort_crv.Curves, Offset=-1)
merge = Merge(Data1=split.ListA, Data2=shift)
weave = Weave(Pattern=larger.LargerThan, Stream0=unweave.Data0, Stream1=merge, NullGaps=False)
weave_2 = Weave(Pattern=larger.LargerThan, Stream0=unweave.Data0, Stream1=split.ListA, NullGaps=False)
end = EndPoints(Curve=weave_2)  # -> Start, End
renumber = RenumberPaths(Data=weave)
renumber_2 = RenumberPaths(Data=end.Start)
shift_2 = ShiftPaths(Data=renumber, Offset=-1)
shift_3 = ShiftPaths(Data=renumber_2, Offset=-1)
D = ClusterOutput(renumber)
D_2 = ClusterOutput(shift_3)

# ==== cluster ReMachining
A = ClusterInput()

# ---- group: Data 1
_1 = ClusterInput()

# ----
relay = ClusterInput()
A_2 = ClusterInput()
A_3 = ClusterInput()
T = ClusterInput()
equals = Equality(FirstNumber=A, SecondNumber=6)  # -> Equality, Inequality
filter = StreamFilter(Gate=equals.Equality, Stream1=_1)
crv = Curve(graft(filter))
division = Division(A=A_2, B=2)
disc = Discontinuity(Curve=crv, Level=1)  # -> Points, Parameters
lng = ListLength(List=disc.Points)
larger = LargerThan(FirstNumber=lng, SecondNumber=0)  # -> LargerThan, OrEqualTo
unweave = Unweave(List=crv, UnweavePattern=larger.LargerThan)  # -> Data0, Data1
prune = PruneTree(Tree=unweave.Data1, Minimum=1, Maximum=0)
topoly = CurveToPolyline(Curve=prune, ToleranceDistance=0, ToleranceAngle=0)  # -> Polyline, Segments
pcen = PolygonCenter(Polyline=topoly.Polyline)  # -> CenterV, CenterE, CenterA
disc_2 = Discontinuity(Curve=topoly.Polyline, Level=1)  # -> Points, Parameters
side = CurveSide(Curve=topoly.Polyline, Point=pcen.CenterV)  # -> Side, Left, Right
cir = Circle(Plane=disc_2.Points, Radius=relay)
trim = TrimWithRegion(Curve=cir, Region=prune)  # -> Inside, Outside
len = Length(Curve=trim.Inside)
len_2 = Length(Curve=trim.Outside)
division_2 = Division(A=len, B=relay)
division_3 = Division(A=len_2, B=relay)
hypot = Expression(x=relay, y=division_2, Expression="2 * x * sin(y/2)")
catet = Expression(x=relay, y=division_2, Expression="x / tan(y/2)")
catet_2 = Expression(x=relay, y=division_3, Expression="x / tan(y/2)")
shift = ShiftPaths(Data=simplify(catet), Offset=-1)
shift_2 = ShiftPaths(Data=simplify(catet_2), Offset=-1)
smaller = SmallerThan(FirstNumber=shift, SecondNumber=0)  # -> SmallerThan, OrEqualTo
smaller_2 = SmallerThan(FirstNumber=shift_2, SecondNumber=0)  # -> SmallerThan, OrEqualTo
cull = CullPattern(List=disc_2.Points, CullPattern=invert(smaller.OrEqualTo))
cull_2 = CullPattern(List=shift, CullPattern=invert(smaller.OrEqualTo))
cull_3 = CullPattern(List=disc_2.Points, CullPattern=invert(smaller_2.OrEqualTo))
cull_4 = CullPattern(List=shift_2, CullPattern=invert(smaller_2.OrEqualTo))
division_4 = Division(A=cull_2, B=2)
panel = Panel(cull_4)
panel_2 = Panel(cull_2)
cir_2 = Circle(Plane=cull_3, Radius=cull_4)
cir_3 = Circle(Plane=cull, Radius=division_4)
division_5 = Division(A=relay, B=Slider(1.1, range=0..10))
trim_2 = TrimWithRegion(Curve=prune, Region=cir_2)  # -> Inside, Outside
trim_3 = TrimWithRegion(Curve=prune, Region=cir_3)  # -> Inside, Outside
fillet = Fillet(Curve=prune, Radius=division_5)
shift_3 = ShiftPaths(Data=trim_2.Inside, Offset=-1)
shift_4 = ShiftPaths(Data=trim_3.Inside, Offset=-1)
dispatch = Dispatch(List=fillet, DispatchPattern=side.Right)  # -> ListA, ListB
dispatch_2 = Dispatch(List=shift_4, DispatchPattern=side.Right)  # -> ListA, ListB
close = CloseCurve(Curve=dispatch_2.ListB, Factor=0.5, Continuity=0)
area = Area(Geometry=close)  # -> Area, Centroid
neg = Negative(Value=division)
dispatch_3 = Dispatch(List=shift_3, DispatchPattern=side.Right)  # -> ListA, ListB
cir_4 = Circle(Plane=PlaneXY(0, 0, 0), Radius=1)
side_2 = CurveSide(Curve=dispatch_2.ListB, Point=area.Centroid)  # -> Side, Left, Right
flip = FlipCurve(Curve=cir_4)  # -> Curve, Flag
offset_inner = OffsetInner(Curve=dispatch.ListB, InnerDist=Slider(1, range=0..1), OffsetPlane=PlaneXY(0, 0, 0))
offset = OffsetCurve(Curve=dispatch_3.ListA, Distance=neg, Corners=1)
offset_2 = OffsetCurve(Curve=dispatch.ListA, Distance=division, Corners=1)
dispatch_4 = Dispatch(List=cir_4, DispatchPattern=side_2.Left)  # -> ListA, ListB
flip_2 = FlipCurve(Curve=dispatch_2.ListB, Guide=dispatch_4.ListA)  # -> Curve, Flag
close_2 = CloseCurve(Curve=offset, Factor=0.5, Continuity=0)
offset_3 = OffsetCurve(Curve=offset_inner, Distance=neg, Corners=1)
shift_5 = ShiftPaths(Data=simplify(close_2), Offset=-1)
offset_4 = OffsetCurve(Curve=flip_2.Curve, Distance=neg, Corners=1)
repeat = RepeatData(Data=division, Length=Slider(7, range=0..10))
ma = MassAddition(Input=repeat)  # -> Result, PartialResults
close_3 = CloseCurve(Curve=offset_4, Factor=0.5, Continuity=0)
shift_6 = ShiftPaths(Data=simplify(close_3), Offset=-1)
trim_4 = TrimWithRegion(Curve=offset_inner, Region=shift_6)  # -> Inside, Outside
trim_5 = TrimWithRegion(Curve=shift_6, Region=offset_inner)  # -> Inside, Outside
trim_6 = TrimWithRegion(Curve=offset_2, Region=shift_5)  # -> Inside, Outside
trim_7 = TrimWithRegion(Curve=shift_5, Region=offset_2)  # -> Inside, Outside
join = JoinCurves(Curves=[trim_5.Outside, trim_4.Inside], Preserve=False)  # -> simplify(Curves)
join_2 = JoinCurves(Curves=[trim_7.Inside, trim_6.Inside], Preserve=False)  # -> simplify(Curves)
shift_7 = ShiftPaths(Data=simplify(join), Offset=-1)
shift_8 = ShiftPaths(Data=simplify(join_2), Offset=-1)
clean = CleanTree(RemoveNulls=True, RemoveInvalid=True, RemoveEmpty=invert(False), Tree=shift_8)
clean_2 = CleanTree(RemoveNulls=True, RemoveInvalid=True, RemoveEmpty=invert(False), Tree=close_3)
polyoffset = PolylineOffset(
    Polylines=clean_2,
    Distance=ma.PartialResults,
    Plane=Plane(origin=(0, 0, 0), x=(0, 0, 0), y=(0, 0, 0)),
    Tolerance=0.001,
    ClosedFillet=0,
    OpenFillet=0,
    Miter=2)  # -> Contour, Holes
polyoffset_2 = PolylineOffset(
    Polylines=clean,
    Distance=ma.PartialResults,
    Plane=Plane(origin=(0, 0, 0), x=(0, 0, 0), y=(0, 0, 0)),
    Tolerance=0.001,
    ClosedFillet=0,
    OpenFillet=0,
    Miter=2)  # -> Contour, Holes
shift_9 = ShiftPaths(Data=simplify(polyoffset_2.Holes), Offset=-1)
shift_10 = ShiftPaths(Data=simplify(polyoffset.Holes), Offset=-1)
crv_2 = Curve(polyoffset.Contour)
smart_merge = SmartMerge(D1=clean_2, D2=shift_10, D3=clean, D4=shift_9, ec=False, fa=False, ha=False, link=False)
panel_3 = Panel(shift_10)
panel_4 = Panel(smart_merge)
clean_3 = CleanTree(RemoveNulls=True, RemoveInvalid=True, RemoveEmpty=invert(False), Tree=smart_merge)
pocketoffset_connection = PocketOffsetConnection(A=A_3, B=clean_3)
shift_11 = ShiftPaths(Data=pocketoffset_connection, Offset=-1)
polyoffset_3 = PolylineOffset(
    Polylines=pocketoffset_connection,
    Distance=division,
    Plane=Plane(origin=(0, 0, 0), x=(0, 0, 0), y=(0, 0, 0)),
    Tolerance=0.001,
    ClosedFillet=0,
    OpenFillet=1,
    Miter=2)  # -> Contour, Holes
shift_12 = ShiftPaths(Data=pocketoffset_connection, Offset=-1)
move = Move(Geometry=shift_11, Motion=T)  # -> Geometry, Transform
graft = GraftTree(Tree=shift_12, IncludeEmptyLists=True, IncludeNullItems=True)
polyboolean = PolylineBoolean(
    A=polyoffset_3.Contour,
    B=polyoffset_3.Holes,
    BooleanType=2,
    Plane=Plane(origin=(0, 0, 0), x=(0, 0, 0), y=(0, 0, 0)),
    Tolerance=0.001,
    EvenOdd=True)
T_2 = ClusterOutput(graft)
G = ClusterOutput(move.Geometry)
panel_5 = Panel(graft)
boundary = BoundarySurfaces(Edges=polyboolean)
S = ClusterOutput(boundary)

# ==== cluster Cluster_19
crv = ClusterInput()
relay = ClusterInput()
crv_2 = Curve(crv)
cls = Closed(Curve=crv_2)  # -> Closed, Periodic
dispatch = Dispatch(List=crv_2, DispatchPattern=cls.Closed)  # -> ListA, ListB
cluster = Cluster_18(C=dispatch.ListA)  # -> C_2, crv_2
gate = StreamGate(Stream=cluster.crv_2, Gate=relay)  # -> Target0, Target1
crv_3 = Curve(gate.Target1)
boundary = BoundarySurfaces(Edges=gate.Target1)
edges = BrepEdges(Brep=boundary)  # -> Naked, Interior, NonManifold
border = SurfaceBorder(Surface=boundary)  # -> OuterBorder, InnterBorder
join = JoinCurves(Curves=edges.Naked, Preserve=False)  # -> simplify(Curves)
area = Area(Geometry=join)  # -> Area, Centroid
extremums = MinMax(Number=area.Area)  # -> Minimum, Maximum
mindex = MemberIndex(Set=area.Area, Member=extremums.Maximum)  # -> Index, Count
panel = Panel(mindex.Index)
item = ListItem(List=join, Index=mindex.Index, Wrap=True)  # -> simplify(Item)
lng = ListLength(List=item)
null = NullItem(Item=lng)  # -> NullFlags, InvalidFlags, Description
f_massbool = MassBoolean(Values=flatten(null.NullFlags), BooleanOperator="AND")
relay_2 = Relay([dispatch.ListB, cluster.C_2])
filter = StreamFilter(Gate=f_massbool, Stream0=lng, Stream1=0)
cull_i = CullIndex(List=join, Indices=mindex.Index, Wrap=True)  # -> simplify(List)
path = ConstructPath(Indices=filter)
tstat = TreeStatistics(Tree=relay_2)  # -> Paths, Length, Count
filter_2 = StreamFilter(Gate=relay, Stream0=gate.Target0, Stream1=border.OuterBorder)
replace = ReplacePaths(Data=relay_2, Search=tstat.Paths)
flatten = FlattenTree(Tree=relay_2, Path="{0}")
renumber = RenumberPaths(Data=filter_2)
renumber_2 = RenumberPaths(Data=border.InnterBorder)
join_2 = JoinCurves(Curves=flatten, Preserve=False)
outside = ClusterOutput(renumber)
inside = ClusterOutput(renumber_2)
panel_2 = Panel(flatten)
open = ClusterOutput(join_2)

# ==== cluster ChangeCurveSeam
G = ClusterInput()
crv = ClusterInput()
crv_2 = ClusterInput()
crv_3 = Curve(crv)
suirify = Suirify(crv_3)
graft = GraftTree(Tree=crv_3, IncludeEmptyLists=True, IncludeNullItems=True)  # -> simplify(Tree)
tstat = TreeStatistics(Tree=suirify)  # -> Paths, Length, Count
crv_4 = Curve(crv_2)
end = EndPoints(Curve=graft)  # -> Start, End
end_2 = EndPoints(Curve=crv_4)  # -> Start, End
brec = BoundingRectangle(Geometry=graft, Plane=PlaneXY(0, 0, 0), Axis=0, Slide=0, Union=True)  # -> Bounding, DimensionX, DimensionY
clean = CleanTree(RemoveNulls=True, RemoveInvalid=True, RemoveEmpty=False, Tree=brec.Bounding)
box_corners = BoxCorners(Box=clean)  # -> CornerA, CornerB, CornerC, CornerD, CornerE, CornerF, CornerG, CornerH
filter = StreamFilter(
    Gate=G,
    Stream0=box_corners.CornerA,
    Stream1=box_corners.CornerB,
    Stream2=box_corners.CornerC,
    Stream3=box_corners.CornerD,
    Stream4=end_2.Start)
crv_cp = CurveClosestPoint(Point=filter, Curve=graft)  # -> Point, Parameter, Distance
sort = SortList(Keys=crv_cp.Distance, ValuesA=crv_cp.Parameter, ValuesB=crv_cp.Point)  # -> Keys, ValuesA, ValuesB
cls = Closed(Curve=graft)  # -> Closed, Periodic
item = ListItem(List=sort.ValuesA, Index=0, Wrap=True)
unweave = Unweave(List=graft, UnweavePattern=cls.Periodic)  # -> Data0, Data1
seam = Seam(Curve=unweave.Data1, Seam=item)
tstat_2 = TreeStatistics(Tree=graft)  # -> Paths, Length, Count
shatter = Shatter(Curve=unweave.Data0, Parameters=item)
weave = Weave(Pattern=cls.Periodic, Stream0=shatter, Stream1=seam, NullGaps=False)
suirify_2 = Suirify(weave)
tstat_3 = TreeStatistics(Tree=suirify_2)  # -> Paths, Length, Count
subtraction = Subtraction(A=tstat_3.Count, B=tstat_2.Count)
cluster = Cluster_7(T=weave)
neg = Negative(Value=subtraction)
shift = ShiftPaths(Data=weave, Offset=neg)  # -> simplify(Data)
tstat_4 = TreeStatistics(Tree=shift)  # -> Paths, Length, Count
replace = ReplacePaths(Data=shift, Search=tstat_4.Paths, Replace=tstat_2.Paths)
panel = Panel(replace)
flatten = FlattenTree(Tree=replace, Path=tstat.Paths)
T = ClusterOutput(flatten)

# ==== cluster CurveToArcsAndLines
C = ClusterInput()
number_slider = Slider(0.05, range=0..0.1)
number_slider_2 = Slider(0.03, range=0..0.1)
number_slider_3 = Slider(5, range=0..10)
panel = Panel("10")
panel_2 = Panel("1000")
c_script = CSharpScript(curve=C, tolerance=number_slider_2)  # -> out, A; inputs curve: Curve, tolerance: Double, angleTolerance: Double, min: Double, max: Double; disabled
# ---------- c_script: C# ----------
    A = curve.ToArcsAndLines(tolerance, angleTolerance, min, max);
# ---------- end c_script ----------
ggcc = GgConvCurve(Curve=C, Tol=number_slider_2, AngleTolerance=number_slider_3, Polyline=False)  # -> Curve, Simplified; disabled
pltolinearc = PolylineToLinesAndArcs(Curve=C, Tolerance=0.01)  # -> Polyline, PolyCurve
ggpl2pc = GgPolylineToPolyCurve(Curve=C, Tol=0.001, AngleTolerance=0.01745329252)  # disabled
explode = Explode(Curve=c_script.A, Recursive=True)  # -> Segments, Vertices
explode_2 = Explode(Curve=ggcc.Curve, Recursive=True)  # -> Segments, Vertices
join = JoinCurves(Curves=explode.Segments, Preserve=False)
join_2 = JoinCurves(Curves=explode_2.Segments, Preserve=False)
simplify = SimplifyCurve(Curve=join, Tolerance=number_slider_2, AngleTolerance=number_slider_3)  # -> Curve, Simplified
simplify_2 = SimplifyCurve(Curve=join_2, Tolerance=number_slider_2, AngleTolerance=number_slider_3)  # -> Curve, Simplified
end = EndPoints(Curve=C)  # -> Start, End
simplify_3 = SimplifyCurve(Curve=pltolinearc.PolyCurve, Tolerance=number_slider_2, AngleTolerance=number_slider_3)  # -> Curve, Simplified
cls = Closed(Curve=pltolinearc.PolyCurve)  # -> Closed, Periodic
dispatch = Dispatch(List=pltolinearc.PolyCurve, DispatchPattern=cls.Closed)  # -> ListA, ListB
dispatch_2 = Dispatch(List=end.Start, DispatchPattern=cls.Closed)  # -> ListA, ListB
crv_cp = CurveClosestPoint(Point=flatten(dispatch_2.ListA), Curve=dispatch.ListA)  # -> Point, Parameter, Distance
sort = SortList(Keys=crv_cp.Distance, ValuesA=crv_cp.Parameter, ValuesB=crv_cp.Point)  # -> Keys, ValuesA, ValuesB
item = ListItem(List=sort.ValuesA, Index=0, Wrap=True)
seam = Seam(Curve=dispatch.ListA, Seam=item)
merge = Merge(Data1=dispatch.ListB, Data2=seam)
R = ClusterOutput(merge)

# ==== cluster Cluster_10
C = ClusterInput()
L = ClusterInput()
d = ClusterInput()
x0 = ClusterInput()
y0 = ClusterInput()
topoly = CurveToPolyline(Curve=flatten(C), ToleranceDistance=0, ToleranceAngle=0)  # -> Polyline, Segments
explode = Explode(Curve=topoly.Polyline, Recursive=True)  # -> Segments, Vertices
lng = ListLength(List=explode.Vertices)
item = ListItem(List=explode.Vertices, Index=expr("x-1", lng), Wrap=True)
pdecon = Deconstruct(Point=item)  # -> XComponent, YComponent, ZComponent

subtraction = Subtraction(A=pdecon.XComponent, X0=x0)
subtraction_2 = Subtraction(A=pdecon.YComponent, Y0=y0)

roundd = RoundToDecimalPlace(NumberX=subtraction, DecimalPlace=d, RoundType=0)  # -> Rounded, Difference
roundd_2 = RoundToDecimalPlace(NumberX=subtraction_2, DecimalPlace=d, RoundType=0)  # -> Rounded, Difference
roundd_3 = RoundToDecimalPlace(NumberX=pdecon.ZComponent, DecimalPlace=d, RoundType=0)  # -> Rounded, Difference
lng_2 = ListLength(List=L)
stack = StackData(Data="G0", Stack=lng_2)  # -> simplify(Data)
format = Format(Format="Y{0}", Culture=127, Data0=roundd_2.Rounded)  # -> simplify(graft(Text))
format_2 = Format(Format="X{0}", Culture=127, Data0=roundd.Rounded)  # -> simplify(graft(Text))
format_3 = Format(Format="Z{0}", Culture=127, Data0=roundd_3.Rounded)  # -> simplify(Text)
renumber = RenumberPaths(Data=stack)
renumber_2 = RenumberPaths(Data=format_2)
renumber_3 = RenumberPaths(Data=format)
renumber_4 = RenumberPaths(Data=format_3)
merge = Merge(Data1=renumber, Data2=renumber_2, Data3=renumber_3, Data4=renumber_4)
join = TextJoin(Text=merge, Join=" ")  # -> simplify(Result)
lng_3 = ListLength(List=item)
partition = PartitionList(List=join, Size=lng_3)  # -> simplify(Chunks)
C_2 = ClusterOutput(partition)

# ==== cluster LinesToGCODE
number_slider = Slider(3, range=0..5)
C = ClusterInput()
D = ClusterInput()
d = ClusterInput()
x0 = ClusterInput()
y0 = ClusterInput()
end = EndPoints(Curve=C)  # -> Start, End
pt = Point(end.End)
pdecon = Deconstruct(Point=pt)  # -> XComponent, YComponent, ZComponent
subtraction = Subtraction(A=pdecon.XComponent, X0=x0)
subtraction_2 = Subtraction(A=pdecon.YComponent, Y0=y0)
lng = ListLength(List=pt)
lng_2 = ListLength(List=pt)
roundd = RoundToDecimalPlace(NumberX=subtraction_2, DecimalPlace=d, RoundType=0)  # -> Rounded, Difference
stack = StackData(Data="1", Stack=lng_2)
roundd_2 = RoundToDecimalPlace(NumberX=subtraction, DecimalPlace=d, RoundType=0)  # -> Rounded, Difference
roundd_3 = RoundToDecimalPlace(NumberX=pdecon.ZComponent, DecimalPlace=d, RoundType=0)  # -> Rounded, Difference
stack_2 = StackData(Data=D, Stack=lng)
format = Format(
    Format="G{0} X{1} Y{2} Z{3} F{4}",
    Culture=127,
    Data0=stack,
    Data1=roundd_2.Rounded,
    Data2=roundd.Rounded,
    Data3=roundd_3.Rounded,
    Data4=stack_2)
lng_3 = ListLength(List=flatten(C))
bool = Boolean(lng_3)
filter = StreamFilter(Gate=bool, Stream1=format)
s_1 = ClusterOutput(filter)

# ==== cluster Cluster_11
C = ClusterInput()
B = ClusterInput()
d = ClusterInput()
x0 = ClusterInput()
y0 = ClusterInput()
topoly = CurveToPolyline(Curve=C, ToleranceDistance=0, ToleranceAngle=0)  # -> Polyline, Segments
explode = Explode(Curve=topoly.Polyline, Recursive=True)  # -> Segments, Vertices
item = ListItem(List=explode.Vertices, Index=0, Wrap=True)
pdecon = Deconstruct(Point=explode.Vertices)  # -> XComponent, YComponent, ZComponent
concat = Concatenate(FragmentA=" F", FragmentB=B)

subtraction = Subtraction(A=pdecon.XComponent, X0=x0)
subtraction_2 = Subtraction(A=pdecon.YComponent, Y0=y0)

merge = Merge(Data2=concat)
roundd = RoundToDecimalPlace(NumberX=subtraction, DecimalPlace=d, RoundType=0)  # -> Rounded, Difference
roundd_2 = RoundToDecimalPlace(NumberX=subtraction_2, DecimalPlace=d, RoundType=0)  # -> Rounded, Difference
roundd_3 = RoundToDecimalPlace(NumberX=pdecon.ZComponent, DecimalPlace=d, RoundType=0)  # -> Rounded, Difference
panel = Panel(merge)
format = Format(Format="X{0}", Culture=127, Data0=roundd.Rounded)  # -> simplify(Text)
format_2 = Format(Format="Y{0}", Culture=127, Data0=roundd_2.Rounded)  # -> simplify(Text)
format_3 = Format(Format="Z{0}", Culture=127, Data0=roundd_3.Rounded)  # -> simplify(Text)
panel_2 = Panel("""G0 
G1 """)
concat_2 = Concatenate(FragmentA=panel_2, FragmentB=format)
concat_3 = Concatenate(FragmentA=format_3, FragmentB=panel)
merge_2 = Merge(Data2=graft(concat_2), Data3=graft(format_2), Data4=graft(concat_3))
join = TextJoin(Text=merge_2, Join=" ")  # -> simplify(Result)
lng = ListLength(List=explode.Vertices)  # -> flatten(Length)
partition = PartitionList(List=simplify(flatten(join)), Size=lng)  # -> simplify(Chunks)
C_2 = ClusterOutput(partition)
i = ClusterOutput(item)

# ==== cluster Cluster_13
number_slider = Slider(3, range=0..10)
crv = ClusterInput()
D = ClusterInput()
d = ClusterInput()
x0 = ClusterInput()
y0 = ClusterInput()
crv_2 = Curve(crv)
end = EndPoints(Curve=crv_2)  # -> Start, End
darc = DeconstructArc(Arc=crv_2)  # -> BasePlane, Radius, Angle
pdecon = Deconstruct(Point=end.End)  # -> XComponent, YComponent, ZComponent
pdecon_2 = Deconstruct(Point=end.Start)  # -> XComponent, YComponent, ZComponent
pdecon_3 = Deconstruct(Point=darc.BasePlane)  # -> XComponent, YComponent, ZComponent
panel = Panel("""X2 Y2 I J F
I = X(C)-X(1)
J = Y(C)-Y(1)""")
subtraction = Subtraction(A=pdecon.XComponent, X0=x0)
subtraction_2 = Subtraction(A=pdecon.YComponent, Y0=y0)
subtraction_3 = Subtraction(A=pdecon_3.XComponent, B=pdecon_2.XComponent)
subtraction_4 = Subtraction(A=pdecon_3.YComponent, B=pdecon_2.YComponent)
cluster = Cluster_12(C=crv_2, P=darc.BasePlane)
roundd = RoundToDecimalPlace(NumberX=subtraction, DecimalPlace=d, RoundType=0)  # -> Rounded, Difference
roundd_2 = RoundToDecimalPlace(NumberX=subtraction_2, DecimalPlace=d, RoundType=0)  # -> Rounded, Difference
roundd_3 = RoundToDecimalPlace(NumberX=pdecon.ZComponent, DecimalPlace=d, RoundType=0)  # -> Rounded, Difference
roundd_4 = RoundToDecimalPlace(NumberX=subtraction_3, DecimalPlace=d, RoundType=0)  # -> Rounded, Difference
roundd_5 = RoundToDecimalPlace(NumberX=subtraction_4, DecimalPlace=d, RoundType=0)  # -> Rounded, Difference
lng = ListLength(List=cluster)
stack = StackData(Data=D, Stack=lng)  # -> simplify(Data)
format = Format(
    Format="G{0} X{1} Y{2} Z{3} I{4} J{5} F{6}",
    Culture=127,
    Data0=cluster,
    Data1=roundd.Rounded,
    Data2=roundd_2.Rounded,
    Data3=roundd_3.Rounded,
    Data4=roundd_4.Rounded,
    Data5=roundd_5.Rounded,
    Data6=stack)
lng_2 = ListLength(List=flatten(crv_2))
bool = Boolean(lng_2)
filter = StreamFilter(Gate=bool, Stream1=format)
s_1 = ClusterOutput(filter)

# ==== cluster Connect
A = ClusterInput()
A_2 = ClusterInput()
B = ClusterInput()
multiplication = Multiplication(A=A_2, B=Slider(4, range=0..10))
box_corners = BoxCorners(Box=B)  # -> CornerA, CornerB, CornerC, CornerD, CornerE, CornerF, CornerG, CornerH
pgroups = PointGroups(Points=box_corners.CornerD, Distance=multiplication)  # -> Groups, Indices
shift = ShiftPaths(Data=pgroups.Indices, Offset=-1)
lng = ListLength(List=pgroups.Groups)
item = ListItem(List=B, Index=shift, Wrap=True)
shift_2 = ShiftPaths(Data=lng, Offset=-1)
partition = PartitionList(List=item, Size=shift_2)
area = Area(Geometry=partition)  # -> Area, Centroid
sort = SortList(Keys=area.Area, ValuesA=partition)  # -> Keys, reverse(ValuesA)
split = SplitList(List=sort.ValuesA, Index=1)  # -> ListA, ListB
end = EndPoints(Curve=split.ListA)  # -> Start, End
crv_cp = CurveClosestPoint(Point=end.Start, Curve=split.ListB)  # -> Point, Parameter, Distance
seam = Seam(Curve=split.ListB, Seam=crv_cp.Parameter)
merge = Merge(Data1=simplify(split.ListA), Data2=simplify(seam))
area_2 = Area(Geometry=merge)  # -> Area, Centroid
len = Length(Curve=merge)
sort_2 = SortList(Keys=area_2.Area, ValuesA=merge)  # -> Keys, ValuesA
end_2 = EndPoints(Curve=sort_2.ValuesA)  # -> Start, End
shift_3 = ShiftList(List=end_2.Start, Shift=1, Wrap=True)
ln = Line(StartPoint=end_2.End, EndPoint=shift_3)
cull_i = CullIndex(List=ln, Indices=-1, Wrap=True)
shift_4 = ShiftPaths(Data=cull_i, Offset=-2)
ccx = CurveCurve(CurveA=shift_4, CurveB=sort_2.ValuesA)  # -> Points, ParamsA, ParamsB
cull_i_2 = CullIndex(List=ccx.Points, Indices=-1, Wrap=True)
lng_2 = ListLength(List=cull_i_2)
shift_5 = ShiftPaths(Data=simplify(lng_2), Offset=-1)
cir = Circle(Plane=cull_i_2, Radius=Slider(5, range=0..10))
ma = MassAddition(Input=shift_5)  # -> Result, PartialResults
weave = Weave(Pattern=[0, 1], Stream0=sort_2.ValuesA, Stream1=shift_4, NullGaps=False)
larger = LargerThan(FirstNumber=ma.Result, SecondNumber=0)  # -> LargerThan, OrEqualTo
cluster = Cluster_15(C=weave)
dispatch = Dispatch(List=shift_4, DispatchPattern=larger.LargerThan)  # -> ListA, ListB
connect = ConnectCurves(Curves=cluster, Continuity=0, Close=invert(True), Bulge=1)
pltolinearc = PolylineToLinesAndArcs(Curve=connect, Tolerance=0.01)  # -> Polyline, PolyCurve
la = ClusterOutput(pltolinearc.PolyCurve)

# ==== cluster PocketCleanIslands
number_slider = Slider(19, range=0..100)
crv = ClusterInput()
crv_2 = Curve(crv)
G = ClusterInput()
P = ClusterInput()
D = ClusterInput()
number_slider_2 = Slider(0.1, range=0..1)
Z = UnitZ(Factor=number_slider)
division = Division(A=number_slider, B=2)
boundary = BoundarySurfaces(Edges=crv_2)
runion = RegionUnion(Curves=crv_2)
neg = Negative(Value=division)
extr = Extrude(Base=boundary, Direction=Z)
Z_2 = UnitZ(Factor=neg)
polyoffset = PolylineOffset(
    Polylines=P,
    Distance=D,
    Plane=Plane(origin=(0, 0, 0), x=(0, 0, 0), y=(0, 0, 0)),
    Tolerance=0.001,
    ClosedFillet=0,
    OpenFillet=1,
    Miter=2)  # -> Contour, Holes
cap = CapHoles(Brep=extr)
move = Move(Geometry=cap, Motion=Z_2)  # -> Geometry, Transform
colom = CollisionOneMany(Collider=boundary, Obstacles=polyoffset.Holes)  # -> Collision, Index
c2offset = Clipper2Offset(Polylines=P, Distance=D, JoinType=0, EndType=1, MiterLimit=2, Precision=4, SVGHeight=600, SVGWidth=800)  # -> Holes, Outer, ClipperPath
shapein = ShapeInBrep(Brep=move.Geometry, Shape=polyoffset.Holes)
sift = SiftPattern(List=polyoffset.Holes, SiftPattern=shapein)  # -> Output0, Output1, Output2
null = NullItem(Item=sift.Output0)  # -> NullFlags, InvalidFlags, Description
cull = CullPattern(List=sift.Output0, CullPattern=invert(null.NullFlags))
len = Length(Curve=cull)
larger = LargerThan(FirstNumber=len, SecondNumber=Slider(10, range=0..10))  # -> LargerThan, OrEqualTo
cull_2 = CullPattern(List=cull, CullPattern=larger.OrEqualTo)
c2offset_2 = Clipper2Offset(
    Polylines=cull_2,
    Distance=number_slider_2,
    JoinType=0,
    EndType=1,
    MiterLimit=2,
    Precision=4,
    SVGHeight=600,
    SVGWidth=800)  # -> Holes, Outer, ClipperPath
polyoffset_2 = PolylineOffset(
    Polylines=cull_2,
    Distance=number_slider_2,
    Plane=Plane(origin=(0, 0, 0), x=(0, 0, 0), y=(0, 0, 0)),
    Tolerance=0.001,
    ClosedFillet=0,
    OpenFillet=1,
    Miter=2)  # -> Contour, Holes
pltolinearc = PolylineToLinesAndArcs(Curve=polyoffset_2.Holes, Tolerance=0.01)  # -> Polyline, PolyCurve; disabled
cluster = Cluster_16(C=polyoffset_2.Holes)
shift = ShiftPaths(Data=cluster, Offset=-2)
len_2 = Length(Curve=shift)
smaller = SmallerThan(FirstNumber=len_2, SecondNumber=1)  # -> SmallerThan, OrEqualTo
cull_3 = CullPattern(List=shift, CullPattern=invert(smaller.SmallerThan))
filter = StreamFilter(Gate=G, Stream1=cull_3)
smart_merge = SmartMerge(D1=P, D2=filter, ec=False, fa=False, ha=False, link=False)
merge = Merge(Data1=P, Data2=filter)
R = ClusterOutput(smart_merge)

# ==== cluster Cluster_17
C = ClusterInput()
D = ClusterInput()
topoly = CurveToPolyline(Curve=C, ToleranceDistance=0, ToleranceAngle=0)  # -> Polyline, Segments
brec = BoundingRectangle(Geometry=topoly.Polyline, Plane=PlaneXY(0, 0, 0), Axis=0, Slide=0, Union=True)  # -> Bounding, DimensionX, DimensionY
min = Minimum(A=brec.DimensionX, B=brec.DimensionY)  # -> simplify(Result)
division = Division(A=min, B=D)
division_2 = Division(A=division, B=Slider(1.4, range=0..10))
flatten = FlattenTree(Tree=division_2, Path="{0}")
sort = SortList(Keys=flatten)  # -> reverse(Keys), ValuesA
item = ListItem(List=sort.Keys, Index=0, Wrap=True)
repeat = RepeatData(Data=D, Length=item)  # -> simplify(Data)
ma = MassAddition(Input=repeat)  # -> Result, PartialResults
pr = ClusterOutput(ma.PartialResults)

# ==== cluster GroupGeoInGeo
G = ClusterInput()
S = ClusterInput()
move = Move(Geometry=G, Motion=Vector(0, 0, 10))  # -> Geometry, Transform
extrusion = Extrusion(Curve=move.Geometry, Height=-20, Cap=True)  # -> graft(Result)
shapein = ShapeInBrep(Brep=extrusion, Shape=S)
sift = SiftPattern(List=S, SiftPattern=shapein)  # -> Output0, Output1, Output2
null = NullItem(Item=sift.Output0)  # -> NullFlags, InvalidFlags, Description
cull = CullPattern(List=sift.Output0, CullPattern=invert(null.NullFlags))
crvoverkill_gh = OverkillGH(Curve=cull, Double=0.1)  # -> A, B
A = ClusterOutput(crvoverkill_gh.A)

# ==== cluster PocketOffsetConnection
B = ClusterInput()
A = ClusterInput()
multiplication = Multiplication(A=A, B=Slider(4, range=0..10))
box_corners = BoxCorners(Box=B)  # -> CornerA, CornerB, CornerC, CornerD, CornerE, CornerF, CornerG, CornerH
pgroups = PointGroups(Points=box_corners.CornerA, Distance=multiplication)  # -> Groups, Indices
shift = ShiftPaths(Data=pgroups.Indices, Offset=-1)
lng = ListLength(List=pgroups.Groups)
item = ListItem(List=B, Index=shift, Wrap=True)
shift_2 = ShiftPaths(Data=lng, Offset=-1)
partition = PartitionList(List=item, Size=shift_2)
area = Area(Geometry=partition)  # -> Area, Centroid
sort = SortList(Keys=area.Area, ValuesA=partition)  # -> Keys, reverse(ValuesA)
split = SplitList(List=sort.ValuesA, Index=1)  # -> ListA, ListB
end = EndPoints(Curve=split.ListA)  # -> Start, End
crv_cp = CurveClosestPoint(Point=end.Start, Curve=split.ListB)  # -> Point, Parameter, Distance
seam = Seam(Curve=split.ListB, Seam=crv_cp.Parameter)
merge = Merge(Data1=simplify(split.ListA), Data2=simplify(seam))
area_2 = Area(Geometry=merge)  # -> Area, Centroid
len = Length(Curve=merge)
sort_2 = SortList(Keys=area_2.Area, ValuesA=merge)  # -> Keys, ValuesA
end_2 = EndPoints(Curve=sort_2.ValuesA)  # -> Start, End
shift_3 = ShiftList(List=end_2.Start, Shift=1, Wrap=True)
ln = Line(StartPoint=end_2.End, EndPoint=shift_3)
cull_i = CullIndex(List=ln, Indices=-1, Wrap=True)
shift_4 = ShiftPaths(Data=cull_i, Offset=-2)
weave = Weave(Pattern=[0, 1], Stream0=sort_2.ValuesA, Stream1=shift_4, NullGaps=False)
cluster = Cluster_15(C=weave)
connect = ConnectCurves(Curves=cluster, Continuity=0, Close=invert(True), Bulge=1)
pltolinearc = PolylineToLinesAndArcs(Curve=connect, Tolerance=0.01)  # -> Polyline, PolyCurve
la = ClusterOutput(pltolinearc.PolyCurve)

# ==== cluster Cluster_18
C = ClusterInput()

# ---- group: Detect intersections
mcx = MultipleCurves(Curves=C)  # -> Points, IndexA, IndexB, ParamA, ParamB
pt = ConstructPoint(XCoordinate=mcx.IndexA, YCoordinate=0, ZCoordinate=0)
pt_2 = ConstructPoint(XCoordinate=mcx.IndexB, YCoordinate=0, ZCoordinate=0)
Z = UnitZ(Factor=1)
move = Move(Geometry=pt, Motion=Z)  # -> Geometry, Transform
move_2 = Move(Geometry=pt_2, Motion=Z)  # -> Geometry, Transform
merge = Merge(
    Data1=simplify(graft(pt)),
    Data2=simplify(graft(pt_2)),
    Data3=simplify(graft(move_2.Geometry)),
    Data4=simplify(graft(move.Geometry)))
conmesh = ConstructMesh(Vertices=merge, Faces={A=0, B=1, C=2, D=3})  # -> flatten(Mesh)
mjoin = MeshJoin(Meshes=conmesh)
disjoint = DisjointMesh(Mesh=mjoin)
demesh = DeconstructMesh(Mesh=disjoint)  # -> Vertices, Faces, Colours, Normals
pdecon = Deconstruct(Point=demesh.Vertices)  # -> simplify(XComponent), YComponent, ZComponent
cset = CreateSet(List=pdecon.XComponent)  # -> Set, Map
sort = SortList(Keys=cset.Set)  # -> Keys, ValuesA
cull_i = CullIndex(List=C, Indices=flatten(sort.Keys), Wrap=True)

# ---- group: Detect intersections / Grouped curves
item = ListItem(List=C, Index=sort.Keys, Wrap=True)  # -> simplify(Item)

# ----
split_self_crv = SplitSelfCurve(Curve=item, Tolerance=0.001)  # -> SplitCurves, Params, Points
shift = ShiftPaths(Data=split_self_crv.SplitCurves, Offset=-1)
join = JoinCurves(Curves=shift, Preserve=False)
cx = CurveSelf(Curve=item)  # -> Points, Params
graft = GraftTree(Tree=item, IncludeEmptyLists=True, IncludeNullItems=True)
lng = ListLength(List=cx.Points)
equals = Equality(FirstNumber=lng, SecondNumber=0)  # -> Equality, Inequality
unweave = Unweave(List=graft, UnweavePattern=equals.Equality)  # -> Data0, Data1
srf = Surface(unweave.Data1)
shift_2 = ShiftPaths(Data=srf, Offset=-1)
join_2 = BrepJoin(Breps=shift_2)  # -> Breps, Closed
edges = BrepEdges(Brep=join_2.Breps)  # -> Naked, Interior, NonManifold
shift_3 = ShiftPaths(Data=edges.Naked, Offset=-1)
shift_4 = ShiftPaths(Data=edges.Interior, Offset=-1)
clean = CleanTree(RemoveNulls=True, RemoveInvalid=True, RemoveEmpty=invert(False), Tree=shift_3)
clean_2 = CleanTree(RemoveNulls=True, RemoveInvalid=True, RemoveEmpty=invert(False), Tree=shift_4)
join_3 = JoinCurves(Curves=clean, Preserve=False)
join_4 = JoinCurves(Curves=clean_2, Preserve=False)
shatter = Shatter(Curve=unweave.Data0, Parameters=cx.Params)  # -> simplify(Segments)
boundary = BoundarySurfaces(Edges=item)  # disabled
simplify = SimplifyCurve(Curve=join_3)  # -> Curve, Simplified
simplify_2 = SimplifyCurve(Curve=join_4)  # -> Curve, Simplified
join_5 = BrepJoin(Breps=boundary)  # -> Breps, Closed; disabled
shift_5 = ShiftPaths(Data=shatter, Offset=-1)
C_2 = ClusterOutput(simplify_2.Curve)
join_6 = JoinCurves(Curves=shift_5, Preserve=False)  # -> simplify(Curves)
edges_2 = BrepEdges(Brep=join_5.Breps)  # -> Naked, Interior, NonManifold; disabled
clean_3 = CleanTree(RemoveNulls=True, RemoveInvalid=True, RemoveEmpty=False, Tree=edges_2.Interior)  # disabled
clean_4 = CleanTree(RemoveNulls=True, RemoveInvalid=True, RemoveEmpty=False, Tree=edges_2.Naked)  # disabled
shift_6 = ShiftPaths(Data=clean_3, Offset=-1)  # disabled
shift_7 = ShiftPaths(Data=clean_4, Offset=-1)  # disabled
join_7 = JoinCurves(Curves=shift_6, Preserve=False)  # disabled
join_8 = JoinCurves(Curves=shift_7, Preserve=False)  # disabled

# ---- group: Detect intersections (continued)
runion = RegionUnion(Curves=item)

# ----
merge_2 = Merge(Data1=runion, Data2=cull_i)

# ---- group: Detect intersections (continued)
crv = Curve(flatten(merge_2))

# ----
crv_2 = ClusterOutput(crv)

# ==== cluster Cluster_12
C = ClusterInput()
P = ClusterInput()
side = CurveSide(Curve=C, Point=P)  # -> Side, Left, Right
lng = ListLength(List=side.Left)
stack = StackData(Data="2", Stack=lng)
stack_2 = StackData(Data="3", Stack=lng)
p_n_c = PickNChoose(Pattern=side.Left, Stream0=stack, Stream1=stack_2)
graft = GraftTree(Tree=p_n_c, IncludeEmptyLists=True, IncludeNullItems=True)
R = ClusterOutput(p_n_c)

# ==== cluster Cluster_15
C = ClusterInput()
explode = Explode(Curve=C, Recursive=True)  # -> Segments, Vertices
lng = ListLength(List=explode.Segments)
cls = Closed(Curve=explode.Segments)  # -> Closed, Periodic
equals = Equality(FirstNumber=lng, SecondNumber=1)  # -> Equality, Inequality
and = GateAnd(A=equals.Equality, B=cls.Closed)
dispatch = Dispatch(List=explode.Segments, DispatchPattern=and)  # -> ListA, ListB
divide = DivideCurve(Curve=dispatch.ListA, Count=2, Kinks=False)  # -> Points, Tangents, Parameters
shatter = Shatter(Curve=dispatch.ListA, Parameters=divide.Parameters)  # -> simplify(Segments)
weave = Weave(Pattern=[0, 1], Stream0=shatter, Stream1=dispatch.ListB, NullGaps=False)
shift = ShiftPaths(Data=weave, Offset=-1)
D = ClusterOutput(shift)

# ==== cluster Cluster_16
C = ClusterInput()
explode = Explode(Curve=C, Recursive=True)  # -> Segments, Vertices
python = GhPythonScript(segments=explode.Segments)  # -> out, lines_arcs; same code as python
unweave = Unweave(List=explode.Segments, UnweavePattern=python.lines_arcs)  # -> Data0, Data1
curve_to_arcs_and_lines = CurveToArcsAndLines_2(C=unweave.Data0)
weave = Weave(Pattern=python.lines_arcs, Stream0=curve_to_arcs_and_lines, Stream1=unweave.Data1, NullGaps=False)
connect = ConnectCurves(Curves=weave, Continuity=0, Close=invert(True), Bulge=1)
shift = ShiftPaths(Data=connect, Offset=-1)
D = ClusterOutput(shift)

# ==== cluster CurveToArcsAndLines_2
C = ClusterInput()
pltolinearc = PolylineToLinesAndArcs(Curve=C, Tolerance=0.01)  # -> Polyline, PolyCurve
end = EndPoints(Curve=C)  # -> Start, End
simplify = SimplifyCurve(Curve=pltolinearc.PolyCurve)  # -> Curve, Simplified
cls = Closed(Curve=pltolinearc.PolyCurve)  # -> Closed, Periodic
dispatch = Dispatch(List=pltolinearc.PolyCurve, DispatchPattern=cls.Closed)  # -> ListA, ListB
dispatch_2 = Dispatch(List=end.Start, DispatchPattern=cls.Closed)  # -> ListA, ListB
crv_cp = CurveClosestPoint(Point=flatten(dispatch_2.ListA), Curve=dispatch.ListA)  # -> Point, Parameter, Distance
sort = SortList(Keys=crv_cp.Distance, ValuesA=crv_cp.Parameter, ValuesB=crv_cp.Point)  # -> Keys, ValuesA, ValuesB
item = ListItem(List=sort.ValuesA, Index=0, Wrap=True)
seam = Seam(Curve=dispatch.ListA, Seam=item)
merge = Merge(Data1=dispatch.ListB, Data2=seam)
R = ClusterOutput(merge)
